# Grasshopper definition 160520_blasting_estimator.gh (Grasshopper 0.9.76)
# plug-ins: MeshEdit Components, Python Interpreter, Kangaroo Components

timer = Timer(TimerInterval=1000, Target=counter)  # disabled
panel = Panel("C:\Users\james\Desktop\Box Sync\THE_LIVING\1510_PSoA_SCAFFOLDING\03_WORK\160505_parse data\02_processed\")
end_offset_mm = Slider(0, range=-150..150)
start_offset_mm = Slider(0, range=-150..150)
counter = Counter(Reset=Toggle(True))
addition = Addition(A=counter, B=100)
panel_2 = Panel(addition)
board_label = Panel("D-46")
board_section = Panel("1")
board_width_mm = Panel("235")
number_slider = Slider(103, range=0..309)
start_offset = Number(start_offset_mm)
num = Number(end_offset_mm)
panel_3 = Panel("186")
python = PythonScript()  # -> path
# ---------- python: Python ----------
import sys
sys.path.append(path)

path = ghenv.LocalScope.ghdoc.Path
path = path.split("\\")
path = "\\".join(path[:-1]) + "\\"
# ---------- end python ----------
panel_4 = Panel("cut_data_by_length.json")
path = FilePath(python)
path_2 = FilePath(path)
python_2 = PythonScript(fp=path_2, file="south_layout.json")  # -> out, slotID, board, segment
# ---------- python_2: Python ----------
import json

slotID = []
board = []
segment = []

with open( fp + file, mode="r" ) as infile:
    data = json.load(infile)
    
    for key in data.keys():
        slotID.append( key )
        
        hashIDX = data[key].find("#")
        
        board.append( data[key][:hashIDX] )
        segment.append( data[key][hashIDX+1:] )
# ---------- end python_2 ----------
lng = ListLength(List=python_2.slotID)
smaller = SmallerThan(FirstNumber=number_slider, SecondNumber=lng)  # -> SmallerThan, OrEqualTo
series = Series(Start=0, Step=1, Count=lng)
dispatch = Dispatch(List=number_slider, DispatchPattern=smaller.SmallerThan)  # -> ListA, ListB
int = Integer(dispatch.ListA)
int_2 = Integer(series)
txt = Text(int)
keysearch = KeyValueSearch(Keys=python_2.slotID, Values=int_2, Search=txt)
int_3 = Integer(keysearch)
item = ListItem(List=python_2.board, Index=int_3, Wrap=True)
merge = Merge(Data1=flatten(panel), Data2=flatten(item), Data3=flatten("_dilated_24.png"))  # -> flatten(Result)
item_2 = ListItem(List=python_2.segment, Index=int_3, Wrap=True)
item_3 = ListItem(List=python_2.slotID, Index=int_3, Wrap=True)

# ---- group: blob path
join = TextJoin(Text=merge)

# ----
concat = Concatenate(FragmentA=item, FragmentB=item_2, JoinSeparator=" #")
subtraction = Subtraction(A=item_2, B=1)
int_4 = Integer(item_3)
panel_5 = Panel(python)
data = Data(item)
data_2 = Data(item_2)
img = ImportImage(File=join)
merge_2 = Merge(Data1=python, Data2="south_cut_lengths.json")

# ---- group: mesh resolution dropdown
bbox = BoundingBox(Content=img, Plane=PlaneXY(0, 0, 0))  # -> Box, Box_2
debox = DeconstructBox(Box=bbox.Box_2)  # -> Plane, X, Y, Z
dedomain = DeconstructDomain(Domain=debox.X)  # -> Start, End
dedomain_2 = DeconstructDomain(Domain=debox.Y)  # -> Start, End

# ----
join_2 = TextJoin(Text=merge_2)
file = ReadFile(File=join_2, PerLineParse=False)

# ---- group: VISUALIZE CUT LOCATIONS
ft_mm = Panel("304.8")
python_3 = PythonScript(data=file, boardID=item)  # -> out, a
# ---------- python_3: Python ----------
import json

a = []

d = json.loads(data)

lengths = d[boardID]

sum = 0

for l in lengths:
    sum += l
    a.append(sum)
# ---------- end python_3 ----------
multiplication = Multiplication(A=python_3.a, B=ft_mm)

# ----
division = Division(A=board_width_mm, B=dedomain_2.End)

# ---- group: blob mesh
scale = Scale(Geometry=img, Center=Point(0, 0, 0), Factor=division)  # -> Geometry, Transform

# ----
bbox_2 = BoundingBox(Content=scale.Geometry, Plane=PlaneXY(0, 0, 0))  # -> Box, Box_2
final_mesh = Mesh(scale.Geometry)
blast_spacing_mm = Slider(10, range=5..20)
debox_2 = DeconstructBox(Box=bbox_2.Box_2)  # -> Plane, X, Y, Z
dedomain_3 = DeconstructDomain(Domain=debox_2.Y)  # -> Start, End
dedomain_4 = DeconstructDomain(Domain=debox_2.X)  # -> Start, End
division_2 = Division(A=dedomain_4.End, B=blast_spacing_mm)
division_3 = Division(A=dedomain_3.End, B=blast_spacing_mm)
recgrid = Rectangular(Plane=PlaneXY(0, 0, 0), SizeX=blast_spacing_mm, SizeY=blast_spacing_mm, ExtentX=division_2, ExtentY=division_3)  # -> Cells, flatten(Points)
final_mesh_2 = Mesh(final_mesh)
sample_points = Point(recgrid.Points)
demesh = DeconstructMesh(Mesh=final_mesh_2)  # -> Vertices, Faces, Colours, Normals
meshcp = MeshClosestPoint(Point=sample_points, Mesh=final_mesh_2)  # -> Point, Index, Parameter
deface = DeconstructFace(Face=demesh.Faces)  # -> CornerA, CornerB, CornerC, CornerD
item_4 = ListItem(List=deface.CornerA, Index=meshcp.Index, Wrap=True)
item_5 = ListItem(List=demesh.Colours, Index=item_4, Wrap=True)
argb = SplitARGB(Colour=item_5)  # -> Alpha, Red, Green, Blue
larger = LargerThan(FirstNumber=argb.Red, SecondNumber="0")  # -> LargerThan, OrEqualTo

# ---- group: all points
pt = Point(sample_points)

# ----
dispatch_2 = Dispatch(List=pt, DispatchPattern=larger.LargerThan)  # -> ListA, ListB

# ---- group: cut values
num_2 = Number(multiplication)

# ---- group: knot points
pt_2 = Point(dispatch_2.ListA)

# ---- group: board section
num_3 = Number(subtraction)

# ----
merge_3 = Merge(Data1=flatten("0"), Data2=flatten(num_2))
num_4 = Number(num)
num_5 = Number(start_offset)
python_4 = PythonScript(points=pt_2, cuts=merge_3, section=num_3, startShift=num_5, endShift=num_4)  # -> out, startCut, endCut, split_pts; inputs points: list, cuts: list
# ---------- python_4: Python ----------
import rhinoscriptsyntax as rs

split_pts = []

startCut = max(cuts[int(section)] + startShift, 0)
endCut = cuts[int(section)+1] + endShift

for pt in points:
    p = rs.coerce3dpoint(pt)
    
    if p.X > startCut and p.X < endCut:
        split_pts.append(p)
        continue
# ---------- end python_4 ----------
blast_spacing = Number(blast_spacing_mm)
pt_3 = ConstructPoint(XCoordinate=python_4.startCut, YCoordinate=0, ZCoordinate=0)
pt_4 = ConstructPoint(XCoordinate=python_4.endCut, YCoordinate=0, ZCoordinate=0)
multiplication_2 = Multiplication(A=blast_spacing, B="2")
pt_5 = Point(pt_3)
pt_6 = Point(pt_4)

# ---- group: ISOLATE BLAST AREA BOUNDARY
pt_7 = Point(python_4.split_pts)
del = DelaunayMesh(Points=pt_7, Plane=PlaneXY(0, 0, 0))
faceb = FaceBoundaries(Mesh=del)
len = Length(Curve=faceb)
larger_2 = LargerThan(FirstNumber=len, SecondNumber="45")  # -> LargerThan, OrEqualTo
cullf = CullFaces(Mesh=del, Pattern=larger_2.LargerThan)
disjoint = DisjointMesh(Mesh=cullf)
nakededge = MeshNakedEdge(Mesh=disjoint)  # -> V, A, B
item_6 = ListItem(List=nakededge.V, Index=nakededge.A, Wrap=True)
item_7 = ListItem(List=nakededge.V, Index=nakededge.B, Wrap=True)
ln = Line(StartPoint=item_6, EndPoint=item_7)
join_3 = JoinCurves(Curves=ln, Preserve=False)  # -> flatten(Curves)

# ----
cleaning_zone_overlap = Panel("100")
max_blast_width = Panel("1985")
flex_zone = Panel("600")
pt_8 = Point(pt_5)
pt_9 = Point(pt_6)
python_5 = PythonScript(
    startPt=pt_8,
    endPt=pt_9,
    blob=join_3,
    height=board_width_mm,
    width=max_blast_width,
    flex=flex_zone,
    overlap=cleaning_zone_overlap)  # -> out, zones, blob_1, blastPt_1, blob_2, blastPt_2; inputs startPt: Point3d, endPt: Point3d, blob: list of Curve
# ---------- python_5: Python ----------
import rhinoscriptsyntax as rs
import math

blastPt_1 = []
blob_1 = []
blastPt_2 = []
blob_2 = []
zones = []
a=[]

l_max = 0
r_min = 10000.0

#function to fill blob with point grid
def fillBlob( crv ):
    #output points
    outPts = []
    #extract control points of boundary curve
    cP = rs.CurvePoints(crv)
    x_step = 1000.0
    y_step = 1000.0
    x_min = 10000.0
    x_max = 0
    y_min = 100000.0
    y_max = 0
    for i, pt in enumerate(cP):
        x_min = min(pt.X, x_min)
        x_max = max(pt.X, x_max)
        y_min = min(pt.Y, y_min)
        y_max = max(pt.Y, y_max)
        if i > 0:
            if abs(pt.X - cP[i-1].X) > 0:
                x_step = min( x_step, abs(pt.X - cP[i-1].X))
            if abs(pt.Y - cP[i-1].Y) > 0:
                y_step = min( y_step, abs(pt.Y - cP[i-1].Y))

    
    for y in range( int((y_max-y_min)/y_step ) + 1):
        for x in range( int((x_max-x_min)/x_step) + 1):
            #print "Point @ (" + str(x) + ", " + str(y) + ")"
            newPt = rs.AddPoint((x_min + x_step*x,y_min + y_step*y,0))
            a.append(newPt)
            if rs.PointInPlanarClosedCurve( newPt, crv ):
                outPts.append(newPt)
    
    return outPts

#demarcate blast sections
if endPt.X - startPt.X < width:
    zones.append( rs.AddPolyline([startPt, (startPt.X + width,0,0), (startPt.X + width,height,0), (startPt.X, height,0), startPt]))
else:
    zones.append( rs.AddPolyline([startPt, (width,0,0), (width,height,0), (0, height,0), startPt]))
    zones.append( rs.AddPolyline([endPt, (endPt.X-width,0,0), (endPt.X-width, height,0), (endPt.X, height, 0), endPt]))

for crv in blob:
    #check if centroid is within L half
    centroid = rs.CurveAreaCentroid(crv)[0]
    cP = rs.CurvePoints(crv)
    max_x = max([pt[0] for pt in cP])
    min_x = min([pt[0] for pt in cP])
    
    #check if board board is too long for single pass
    if endPt.X - startPt.X < width:
        blob_1.append( crv )
        blastPt_1.extend( fillBlob(crv) )
        l_max = max( l_max, max_x )
        continue
    
    
    #check if blob is closer to left
    if max_x < startPt.X + width-100:
        #check if in L "safe" zone
        if max_x < (startPt.X + width - flex):
            blob_1.append( crv )
            blastPt_1.extend( fillBlob(crv) )
            l_max = max( l_max, max_x )
            continue
        #not in safe zone
        else:
            #check if blob is completely within L flex zone
            if max_x < startPt.X + width-100:
                blob_1.append( crv )
                blastPt_1.extend( fillBlob(crv) )
                l_max = max( l_max, max_x )
                continue
    
    #check if blob is closer to right
    elif min_x > endPt.X - width:
        #check if in R "safe" zone
        if min_x > endPt.X - width - flex:
            blob_2.append(crv)
            blastPt_2.extend( fillBlob(crv) )
            r_min = min( r_min, min_x )
            continue
        #check if completely within R flex zone
        if min_x > endPt.X - width:
            blob_2.append(crv)
            blastPt_2.extend( fillBlob(crv) )
            r_min = min( r_min, min_x )
            continue
    #blob straddles boundary and must be split
    else:
        l_half = rs.CurveBooleanIntersection(zones[0],crv)
        r_half = rs.CurveBooleanIntersection(zones[1],crv)
        
        blob_1.append( l_half )
        blastPt_1.extend( fillBlob(l_half) )
        blob_2.append( r_half )
        blastPt_2.extend( fillBlob(r_half) )

if len(zones) > 1:
    if len(blastPt_2) < 1:
        l_max = width
        r_min = l_max
    split_x = (r_min - l_max)/2.0 + l_max
else:
    split_x = endPt.X

#shift ends of zones to split
#shift zone 0 points left
z_pt = rs.CurvePoints( zones[0] )

z_pt[1].X = min(split_x + overlap, startPt.X + width-100)
z_pt[2].X = min(split_x + overlap, startPt.X + width-100)

zones[0] = rs.AddPolyline( z_pt )
if len(zones) > 1:
    z1_pt = rs.CurvePoints( zones[0] )
    #shift zone 1 points right
    z_pt = rs.CurvePoints( zones[1] )
    z_pt[1].X = z1_pt[1].X - overlap
    z_pt[2].X = z1_pt[2].X - overlap
    
    zones[1] = rs.AddPolyline( z_pt )
# ---------- end python_5 ----------

cleaning_zone_overlap_2 = Panel("100")
max_blast_width_2 = Panel("1985")
flex_zone_2 = Panel("600")
pt_10 = Point(pt_5)
pt_11 = Point(pt_6)

# ---- group: DIRECITONAL WEIGHTING
number_slider_2 = Slider(2, range=0.5..2)

# ----
number_slider_3 = Slider(300, range=100..300)
number_slider_4 = Slider(10, range=1..20)
python_6 = PythonScript(
    startPt=pt_10,
    endPt=pt_11,
    blob=join_3,
    height=board_width_mm,
    width=max_blast_width_2,
    flex=flex_zone_2,
    overlap=cleaning_zone_overlap_2)  # -> out, zones, blob_1, blastPt_1, blob_2, blastPt_2; inputs startPt: Point3d, endPt: Point3d, blob: list of Curve
# ---------- python_6: Python ----------
import rhinoscriptsyntax as rs
import math

blastPt_1 = []
blob_1 = []
blastPt_2 = []
blob_2 = []
zones = []
a=[]

l_max = 0
r_min = 10000.0

#function to fill blob with point grid
def fillBlob( crv ):
    #output points
    outPts = []
    #extract control points of boundary curve
    cP = rs.CurvePoints(crv)
    x_step = 1000.0
    y_step = 1000.0
    x_min = 10000.0
    x_max = 0
    y_min = 100000.0
    y_max = 0
    for i, pt in enumerate(cP):
        x_min = min(pt.X, x_min)
        x_max = max(pt.X, x_max)
        y_min = min(pt.Y, y_min)
        y_max = max(pt.Y, y_max)
        if i > 0:
            if abs(pt.X - cP[i-1].X) > 0:
                x_step = min( x_step, abs(pt.X - cP[i-1].X))
            if abs(pt.Y - cP[i-1].Y) > 0:
                y_step = min( y_step, abs(pt.Y - cP[i-1].Y))

    
    for y in range( int((y_max-y_min)/y_step ) + 1):
        for x in range( int((x_max-x_min)/x_step) + 1):
            #print "Point @ (" + str(x) + ", " + str(y) + ")"
            newPt = rs.AddPoint((x_min + x_step*x,y_min + y_step*y,0))
            a.append(newPt)
            if rs.PointInPlanarClosedCurve( newPt, crv ):
                outPts.append(newPt)
    
    return outPts

#demarcate blast sections
if endPt.X - startPt.X < width:
    zones.append( rs.AddPolyline([startPt, (startPt.X + width,0,0), (startPt.X + width,height,0), (startPt.X, height,0), startPt]))
else:
    zones.append( rs.AddPolyline([startPt, (width,0,0), (width,height,0), (0, height,0), startPt]))
    zones.append( rs.AddPolyline([endPt, (endPt.X-width,0,0), (endPt.X-width, height,0), (endPt.X, height, 0), endPt]))

for crv in blob:
    #check if centroid is within L half
    centroid = rs.CurveAreaCentroid(crv)[0]
    cP = rs.CurvePoints(crv)
    max_x = max([pt[0] for pt in cP])
    min_x = min([pt[0] for pt in cP])
    
    #check if board board is too long for single pass
    if endPt.X - startPt.X < width:
        blob_1.append( crv )
        blastPt_1.extend( fillBlob(crv) )
        l_max = max( l_max, max_x )
        continue
    
    
    #check if blob is closer to left
    if max_x < startPt.X + width:
        #check if in L "safe" zone
        if max_x < (startPt.X + width - flex):
            blob_1.append( crv )
            blastPt_1.extend( fillBlob(crv) )
            l_max = max( l_max, max_x )
            continue
        #not in safe zone
        else:
            #check if blob is completely within L flex zone
            if max_x < startPt.X + width:
                blob_1.append( crv )
                blastPt_1.extend( fillBlob(crv) )
                l_max = max( l_max, max_x )
                continue
    
    #check if blob is closer to right
    elif min_x > endPt.X - width:
        #check if in R "safe" zone
        if min_x > endPt.X - width - flex:
            blob_2.append(crv)
            blastPt_2.extend( fillBlob(crv) )
            r_min = min( r_min, min_x )
            continue
        #check if completely within R flex zone
        if min_x > endPt.X - width:
            blob_2.append(crv)
            blastPt_2.extend( fillBlob(crv) )
            r_min = min( r_min, min_x )
            continue
    #blob straddles boundary and must be split
    else:
        l_half = rs.CurveBooleanIntersection(zones[0],crv)
        r_half = rs.CurveBooleanIntersection(zones[1],crv)
        
        blob_1.append( l_half )
        blastPt_1.extend( fillBlob(l_half) )
        blob_2.append( r_half )
        blastPt_2.extend( fillBlob(r_half) )

if len(zones) > 1:
    if len(blastPt_2) < 1:
        l_max = width
        r_min = l_max
    split_x = (r_min - l_max)/2.0 + l_max
else:
    split_x = endPt.X

#shift ends of zones to split
#shift zone 0 points left
z_pt = rs.CurvePoints( zones[0] )

z_pt[1].X = min(split_x + overlap, startPt.X + width)
z_pt[2].X = min(split_x + overlap, startPt.X + width)

zones[0] = rs.AddPolyline( z_pt )
if len(zones) > 1:
    z1_pt = rs.CurvePoints( zones[0] )
    #shift zone 1 points right
    z_pt = rs.CurvePoints( zones[1] )
    z_pt[1].X = max(z1_pt[1].X - overlap, z_pt[0].X-width)
    z_pt[2].X = max(z1_pt[2].X - overlap, z_pt[0].X-width)
    
    zones[1] = rs.AddPolyline( z_pt )
# ---------- end python_6 ----------

toggle = BooleanToggle(False)
python_7 = PythonScript(
    points=python_5.blastPt_1,
    startPoint=pt_8,
    startX="0",
    err=multiplication_2,
    xWeight=number_slider_2,
    diagMove=toggle,
    blastSpeed=number_slider_4,
    moveSpeed=number_slider_3)  # -> out, GCODE, lines_00, lines_01; inputs points: list of Point3d, startPoint: Point3d, diagMove: Boolean
# ---------- python_7: Python ----------
import rhinoscriptsyntax as rs
import scriptcontext as sc
import Rhino
import random
import math

sc.doc = ghdoc

moveRef = rs.coerce3dpoint(startPoint)

def gen_GCODE(pt, code):
    if code == 1:
        feed = blastSpeed
        return ["G01" + " X" + str(round(startX + pt[0] - moveRef.X, 3)) + " Y" + str(round(pt[1], 3)) + " F" + str(feed)]
    else:
        feed = moveSpeed
        if diagMove:
            return ["G01" + " X" + str(round(startX + pt[0] - moveRef.X, 3)) + " Y" + str(round(pt[1], 3)) + " F" + str(feed)]
        else:
            line1 = "G01" + " X" + str(round(startX + pt[0] - moveRef.X, 3)) + " F" + str(feed)
            line2 = "G01" + " Y" + str(round(pt[1], 3)) + " F" + str(feed)
            return [line1, line2]

def linearDistance(p1, p2):
    return math.sqrt((p2[0]-p1[0])**2 + xWeight * (p2[1]-p1[1])**2)

#err = 15.00
endPoints = []
lines_00 = []
lines_01 = []
GCODE = []

for point in points:
    pt = rs.coerce3dpoint(point)
    endPoints.append([pt.X, pt.Y])

if startPoint is None:
    curr_Point = endPoints.pop(random.choice(range(len(endPoints))))
    GCODE.extend( gen_GCODE(curr_Point, 0) )
else:
    sp = rs.coerce3dpoint(startPoint)
    curr_Point = [sp.X, sp.Y]

for i in range(len(endPoints)):
    closest = 0
#    dir = 0
    minDist = float("inf")
    
    for j in range(len(endPoints)):
        pt = endPoints[j]
        dist = linearDistance(curr_Point, pt)
        if dist < minDist:
            closest = j
#            dir = k
            minDist = dist
    
    next_Point = endPoints.pop(closest)
    
    if minDist > err:
        GCODE.extend( gen_GCODE(next_Point, 0) )
        if diagMove:
            lines_00.append(rs.AddLine(rs.AddPoint(curr_Point[0], curr_Point[1], 0), rs.AddPoint(next_Point[0], next_Point[1], 0)))
        else:
            if curr_Point[0] - next_Point[0] != 0:
                lines_00.append(rs.AddLine((curr_Point[0], curr_Point[1], 0), (next_Point[0], curr_Point[1], 0) ) )
            if curr_Point[1] - next_Point[1] != 0:
                lines_00.append( rs.AddLine( (next_Point[0], curr_Point[1],0), (next_Point[0], next_Point[1], 0) ) )
    
    else:
        GCODE.extend( gen_GCODE(next_Point, 1) )
        lines_01.append(rs.AddLine(rs.AddPoint(curr_Point[0], curr_Point[1], 0), rs.AddPoint(next_Point[0], next_Point[1], 0)))
    
    curr_Point = next_Point
    
#print GCODE

#trigger = True
# ---------- end python_7 ----------
python_8 = PythonScript(
    points=python_5.blastPt_2,
    startPoint=pt_9,
    startX=max_blast_width,
    err=multiplication_2,
    xWeight=number_slider_2,
    diagMove=toggle,
    blastSpeed=number_slider_4,
    moveSpeed=number_slider_3)  # -> out, GCODE, lines_00, lines_01; inputs points: list of Point3d, startPoint: Point3d, diagMove: Boolean; same code as python_7

python_9 = PythonScript(zones=python_6.zones, machineWidth=max_blast_width_2, spacing="20.0", cleanSpeed="200.0")  # -> out, a, GCODE; inputs zones: Curve
# ---------- python_9: Python ----------
import rhinoscriptsyntax as rs
import math

cP = rs.CurvePoints( zones )
a = []
GCODE = []

def genGCODE( code, inputs ):
    line = "G0" + str(code)
    if code == 2 or code == 3:
        line += " I" + str(round(inputs[0]-x_offset,3)) + " J" + str(round(inputs[1],3))
        line += " X" + str(round(inputs[2]-x_offset,3)) + " Y" + str(round(inputs[3],3))
        line += " F" + str(round(inputs[4],3))
    elif code == 0 or code == 1:
        line += " X" + str(round(inputs[0]-x_offset,3)) + " Y" + str(round(inputs[1],3))
        line += " F" + str(round(inputs[2],3))
    elif code == 4 or code == 5:
        line += " P" + str(round(inputs[0],3))
    else:
        return
    GCODE.append(line)

#determine start and initial direction from L or R sections
startX = cP[0].X
#left side

if cP[0].X < cP[1].X:
    dir = 1.0
    x_offset = startX
#right side
else:
    dir = -1.0
    x_offset = startX - machineWidth
    print x_offset

#connecting arc radius
r = spacing*0.5

#zone dimensions
width = abs(cP[0].X - cP[1].X) - spacing
height = abs(cP[1].Y - cP[2].Y)

#calculate number of passes at spacing and start offset
passes = int(math.ceil(height/spacing))
startH = ((passes*spacing) - height)/-2

def genArc( firstPt, secondPt, radius, direction ):
    arcCenter = ( firstPt[0], (secondPt[1] - firstPt[1])/2.0 + firstPt[1], 0)
    arcDir = (arcCenter[0] + direction, arcCenter[1], 0)
    arcPlane = rs.PlaneFromPoints(arcCenter, firstPt, arcDir)
    #gen gcode
    if direction > 0:
        genGCODE(2,[arcCenter[0],arcCenter[1],secondPt[0],secondPt[1], cleanSpeed])
    else:
        genGCODE(3,[arcCenter[0],arcCenter[1],secondPt[0],secondPt[1], cleanSpeed])
    return rs.AddArc(arcPlane, radius, -180 * abs(dir)) 

#generate starting point
startPt = (startX + dir*r, startH - spacing, 0)

#gen GCODE to move to start position
genGCODE( 0, [startPt[0],-50, cleanSpeed])
#gcode to start blast stream
genGCODE( 5, [3000.0] )
genGCODE( 1, [startPt[0],startPt[1], cleanSpeed])

endPt = (startPt[0], startH, 0)
a.append( genArc( startPt, endPt, r, dir ) )

for i in range( passes + 1 ):
    flip = 1 - 2*(i%2)
    start = (startX + dir*r*flip + dir*(width+spacing)*(i%2), startH + spacing*i,0)
    end = (start[0] + dir*flip*width, start[1], 0)
    a.append( rs.AddLine(start,end) )
    genGCODE(1,[end[0],end[1],cleanSpeed])
    
    nextPt = (end[0],end[1]+spacing,0)
    a.append( genArc( end, nextPt, r, -dir*flip ) )

if nextPt[1] < height+50:
    genGCODE(0,[nextPt[0],height+50,cleanSpeed])

genGCODE(4,[6000.0])
GCODE.append( "G00 X0" )
GCODE.append( "G00 Y0" )
# ---------- end python_9 ----------

python_10 = PythonScript(zones=python_5.zones, machineWidth=max_blast_width, spacing="20.0", cleanSpeed="300.0")  # -> out, a, GCODE; inputs zones: Curve
# ---------- python_10: Python ----------
import rhinoscriptsyntax as rs
import math

cP = rs.CurvePoints( zones )
a = []
GCODE = []

def genGCODE( code, inputs ):
    line = "G0" + str(code)
    if code == 2 or code == 3:
        line += " I" + str(round(inputs[0]-x_offset,3)) + " J" + str(round(inputs[1],3))
        line += " X" + str(round(inputs[2]-x_offset,3)) + " Y" + str(round(inputs[3],3))
        line += " F" + str(round(inputs[4],3))
    elif code == 0 or code == 1:
        line += " X" + str(round(inputs[0]-x_offset,3)) + " Y" + str(round(inputs[1],3))
        line += " F" + str(round(inputs[2],3))
    elif code == 4 or code == 5:
        line += " P" + str(round(inputs[0],3))
    else:
        return
    GCODE.append(line)

#determine start and initial direction from L or R sections
startX = cP[0].X
#left side

if cP[0].X < cP[1].X:
    dir = 1.0
    x_offset = startX
#right side
else:
    dir = -1.0
    x_offset = startX - machineWidth
    print x_offset

#connecting arc radius
r = spacing*0.5

#zone dimensions
width = abs(cP[0].X - cP[1].X) - spacing
height = abs(cP[1].Y - cP[2].Y)

#calculate number of passes at spacing and start offset
passes = int(math.ceil(height/spacing))
startH = ((passes*spacing) - height)/-2

def genArc( firstPt, secondPt, radius, direction ):
    arcCenter = ( firstPt[0], (secondPt[1] - firstPt[1])/2.0 + firstPt[1], 0)
    arcDir = (arcCenter[0] + direction, arcCenter[1], 0)
    arcPlane = rs.PlaneFromPoints(arcCenter, firstPt, arcDir)
    #gen gcode
    if direction > 0:
        genGCODE(2,[arcCenter[0],arcCenter[1],secondPt[0],secondPt[1], cleanSpeed])
    else:
        genGCODE(3,[arcCenter[0],arcCenter[1],secondPt[0],secondPt[1], cleanSpeed])
    return rs.AddArc(arcPlane, radius, -180 * abs(dir)) 

#generate starting point
startPt = (startX + dir*r, startH - spacing, 0)

#gen GCODE to move to start position
GCODE.append("G00 Y-50")
genGCODE( 0, [startPt[0],-50, cleanSpeed])
#gcode to start blast stream
genGCODE( 5, [3000.0] )
genGCODE( 1, [startPt[0],startPt[1], cleanSpeed])

endPt = (startPt[0], startH, 0)
a.append( genArc( startPt, endPt, r, dir ) )

for i in range( passes + 2 ):
    flip = 1 - 2*(i%2)
    start = (startX + dir*r*flip + dir*(width+spacing)*(i%2), startH + spacing*i,0)
    end = (start[0] + dir*flip*width, start[1], 0)
    a.append( rs.AddLine(start,end) )
    genGCODE(1,[end[0],end[1],cleanSpeed])
    
    nextPt = (end[0],end[1]+spacing,0)
    a.append( genArc( end, nextPt, r, -dir*flip ) )

if nextPt[1] < height+50:
    genGCODE(0,[nextPt[0],height+50,cleanSpeed])

genGCODE(4,[6000.0])
GCODE.append( "G00 X0" )
GCODE.append( "G00 Y0" )
# ---------- end python_10 ----------

crv = Curve(python_6.zones)
data_3 = Data(concat)
python_11 = PythonScript(points=python_6.blastPt_1, startPoint=pt_10, startX="0", err=multiplication_2, xWeight=number_slider_2)  # -> out, GCODE, lines_00, lines_01; inputs points: list
# ---------- python_11: Python ----------
import rhinoscriptsyntax as rs
import scriptcontext as sc
import Rhino
import random
import math

sc.doc = ghdoc

moveRef = rs.coerce3dpoint(startPoint)

def gen_GCODE(pt, code):
    if code == 1:
        feed = 5.0
    else:
        feed = 300.0
    return "G01" + " X" + str(round(startX + pt[0] - moveRef.X, 3)) + " Y" + str(round(pt[1], 3)) + " F" + str(feed)
    
def linearDistance(p1, p2):
    return math.sqrt((p2[0]-p1[0])**2 + xWeight * (p2[1]-p1[1])**2)

#err = 15.00
endPoints = []
lines_00 = []
lines_01 = []
GCODE = []

for point in points:
    pt = rs.coerce3dpoint(point)
    endPoints.append([pt.X, pt.Y])

if startPoint is None:
    curr_Point = endPoints.pop(random.choice(range(len(endPoints))))
    GCODE.append( gen_GCODE(curr_Point, 0) )
else:
    sp = rs.coerce3dpoint(startPoint)
    curr_Point = [sp.X, sp.Y]

for i in range(len(endPoints)):
    closest = 0
#    dir = 0
    minDist = float("inf")
    
    for j in range(len(endPoints)):
        pt = endPoints[j]
        dist = linearDistance(curr_Point, pt)
        if dist < minDist:
            closest = j
#            dir = k
            minDist = dist
    
    next_Point = endPoints.pop(closest)
    
    if minDist > err:
        GCODE.append( gen_GCODE(next_Point, 0) )
        lines_00.append(rs.AddLine(rs.AddPoint(curr_Point[0], curr_Point[1], 0), rs.AddPoint(next_Point[0], next_Point[1], 0)))
    else:
        GCODE.append( gen_GCODE(next_Point, 1) )
        lines_01.append(rs.AddLine(rs.AddPoint(curr_Point[0], curr_Point[1], 0), rs.AddPoint(next_Point[0], next_Point[1], 0)))
    
    curr_Point = next_Point
    
print GCODE

#trigger = True
# ---------- end python_11 ----------
python_12 = PythonScript(points=python_6.blastPt_2, startPoint=pt_11, startX=max_blast_width_2, err=multiplication_2, xWeight=number_slider_2)  # -> out, GCODE, lines_00, lines_01; inputs points: list; same code as python_11
concat_2 = Concatenate(FragmentA="$$ ", FragmentB=data_3)
geo = Geometry(python_9.a)
crv_2 = Curve([python_7.lines_00, python_8.lines_00])
crv_3 = Curve([python_7.lines_01, python_8.lines_01])
topoly = CurveToPolyline(Curve=geo, ToleranceDistance=0, ToleranceAngle=0)  # -> Polyline, Segments
null = NullItem(Item=python_7.GCODE)  # -> NullFlags, InvalidFlags, Description
null_2 = NullItem(Item=python_8.GCODE)  # -> NullFlags, InvalidFlags, Description
geo_2 = Geometry(topoly.Polyline)
int_5 = Integer(Slider(1, range=0..10))
int_6 = Integer(Slider(2, range=0..10))
int_7 = Integer(Slider(4, range=0..10))
geo_3 = Geometry(python_6.zones)
col = Colour(ColourSwatch(SwatchColor=RGB(0, 0, 0)))
col_2 = Colour(ColourSwatch(SwatchColor=RGB(150, 150, 150)))
geo_4 = Geometry(crv_2)
col_3 = Colour(ColourSwatch(SwatchColor=RGB(0, 149, 255)))
geo_5 = Geometry(crv_3)
col_4 = Colour(ColourSwatch(SwatchColor=RGB(255, 0, 0)))
int_8 = Integer(Slider(3, range=0..10))
lng_2 = ListLength(List=geo_3)
lng_3 = ListLength(List=geo_2)
lng_4 = ListLength(List=geo_4)
lng_5 = ListLength(List=geo_5)

# ---- group: ADD LABEL HEADER
data_4 = Data(data_3)
bang = ExplodeTree(Data=python_10.GCODE)  # -> _00000, _00001
concat_3 = Concatenate(FragmentA="$$ ", FragmentB=data_4)
merge_4 = Merge(Data1=flatten(concat_3), Data2=flatten("$$R CLEAN$$"), Data3=flatten(bang._00001))  # -> flatten(Result)
merge_5 = Merge(Data1=flatten(concat_3), Data2=flatten("$$L CLEAN$$"), Data3=flatten(bang._00000))  # -> flatten(Result)

# ----
dup = DuplicateData(Data=col, Number=lng_2, Order=True)
dup_2 = DuplicateData(Data=col_2, Number=lng_3, Order=True)
dup_3 = DuplicateData(Data=int_5, Number=lng_3, Order=True)
dup_4 = DuplicateData(Data=col_3, Number=lng_4, Order=True)
dup_5 = DuplicateData(Data=col_4, Number=lng_5, Order=True)
dup_6 = DuplicateData(Data=int_8, Number=lng_2, Order=True)
dup_7 = DuplicateData(Data=int_7, Number=lng_5, Order=True)
dup_8 = DuplicateData(Data=int_6, Number=lng_4, Order=True)
larger_3 = LargerThan(FirstNumber=lng_2, SecondNumber=1)  # -> LargerThan, OrEqualTo
merge_6 = Merge(Data1=flatten(geo_3), Data2=flatten(geo_2), Data3=flatten(geo_4), Data4=flatten(geo_5))
merge_7 = Merge(Data1=flatten(dup), Data2=flatten(dup_2), Data3=flatten(dup_4), Data4=flatten(dup_5))
merge_8 = Merge(Data1=flatten(dup_6), Data2=flatten(dup_3), Data3=flatten(dup_8), Data4=flatten(dup_7))
int_9 = Integer(int_4)
data_5 = Data(concat_2)
data_6 = Data(merge_5)
data_7 = Data(merge_4)
data_8 = Data(data)
data_9 = Data(data_2)
concat_4 = Concatenate(FragmentA=merge_8, FragmentB="px")
python_13 = PythonScript(
    slotID=int_9,
    board=data_8,
    two_part=larger_3.LargerThan,
    segment=data_9,
    polylines=merge_6,
    colors=merge_7,
    strokes=merge_8,
    render=Toggle(True))  # -> out, a; inputs slotID: Int32, two_part: Boolean, segment: Int32, polylines: list of Polyline, colors: list, strokes: list, render: Boolean
# ---------- python_13: Python ----------
try:
    import Rhino
    import scriptcontext
    import System
    import rhinoscriptsyntax as rs
    GH=True
except:
    GH=False
    
bound = polylines[0]
origin_x = bound[0][0]
origin_y = bound[0][1]
if two_part:
    width = abs( bound[0][0] - polylines[1][0][0] )
    height = abs( bound[0][1] - bound[2][1] )
else:
    width = abs( bound[0][0] - bound[2][0] )
    height = abs( bound[0][1] - bound[2][1] )

fp = "C://Users//james//Documents//GitHub//blast-bot//GH//SVG//"
file = "slot_%03i_%s-%i.svg" %(slotID,board,segment)
print file

'''This module is currently just a rough shot for sketching out ideas about svg
export.'''

def _s(o):
    if isinstance(o, str):
        if '_' in o:
            return o.replace('_','-')
        else: return o
    elif isinstance(o, System.Drawing.Color):
        return System.Drawing.ColorTranslator.ToHtml(att)
    else:
        return o

def xml_attributes(**kwargs):
    att_mask = '%s="%s"'
    return ' '.join([att_mask % (_s(k), kwargs[k]) for k in kwargs])

def to_svg(**kwargs):
    tag = kwargs.pop('tag')
    return '<%s %s />' % (tag, xml_attributes(**kwargs))

class svgRenderable(object):
    def render(self):
        if self.tag:
            return to_svg(**vars(self))
        else:
            print 'ERROR: no tag name'
            return

class svgPath(svgRenderable):
    def __init__(self, coords, color='#000', stroke='5px'):
        self.tag = 'path'
        self.fill = 'none'
        self.stroke = self.parse_color(color)
        #self.stroke_width = self.parse_stroke(stroke)
        self.stroke_width = self.parse_stroke(stroke)
        self.d = self.parse_coords(coords)
    def parse_coords(self, coords):
        coord_pairs = ['%s %s' % (c[0], c[1]) for c in coords]
        return 'M %s' % ' L '.join(coord_pairs)
    def parse_stroke(self, stroke):
        if isinstance(stroke, int) or isinstance(stroke, float):
            return '%spx' % stroke
        else: return stroke
    def parse_color(self, color):
        if isinstance(color, System.Drawing.Color):
            return System.Drawing.ColorTranslator.ToHtml(color)
        else: return color

def polylineToPath(polyline, color='#000', stroke='1px'):
    # get points from polyline
    pts = [pt for pt in polyline]
    # convert them to path coords
    coords = [(p.X-origin_x, height+origin_y-p.Y) for p in pts]
    path = svgPath(coords, color, stroke)
    return path.render()


def svg_wrap(*args):
    wrapper = '''<svg width="''' + str(width) + '''" height="''' + str(height) + '''" xmlns="http://www.w3.org/2000/svg" version="1.1">
%s
</svg>'''
    return wrapper % '\n'.join(args)


def test():
    c1 = to_svg(tag='circle', r='10', cx=50, cy=20,
             stroke='#FF0000', fill='#0A0A0A')
    c = svgCircle(30, 70, 15)
    return svg_wrap(c1,c.render())

if GH:
    if polylines and render:
        outlist = []
        for i, p in enumerate(polylines):
            if p:
                #print strokes[i]
                #print colors[i]
                outlist.append(polylineToPath(p, colors[i], strokes[i]))
        a = svg_wrap(*outlist)
            
            


with open( fp + file, mode="w" ) as outfile:
    outfile.write(a)
# ---------- end python_13 ----------
panel_6 = Panel("300.0")  # disabled
panel_7 = Panel("80.0")  # disabled
panel_8 = Panel("1.0")  # disabled
python_14 = PythonScript(code=data_6)  # -> out, newCode; inputs code: list
# ---------- python_14: Python ----------
newCode = []
offset = 0;

for i, line in enumerate(code):
    if line[0] != "$":
        newCode.append( "N" + str(i-offset) + " " + line );
    else:
        offset += 1
        newCode.append( line )
# ---------- end python_14 ----------
python_15 = PythonScript(code=data_7)  # -> out, newCode; inputs code: list; same code as python_14
python_16 = PythonScript(CODE=data_6, x_max=panel_6, y_max=panel_7, mm_per_segment=panel_8)  # -> out, TIME_COUNT; inputs CODE: list; disabled
# ---------- python_16: Python ----------
import math

lastPos = (0,0,0)
lastFeed = 50.0

TIME_COUNT = []

def determineFeedrate(dx, dy, f):
    vec = math.sqrt( dx*dx + dy*dy )
    vx = min( x_max, f * dx / vec)
    vy = min( y_max, f * dy / vec)
    return math.sqrt( vx * vx + vy * vy )

def atan3( dy, dx ):
    a = math.atan2( dy, dx )
    if a < 0 :
        a += math.pi * 2.0
    return a

for line in CODE:
    #skip first line
    if line[0] == '$':
        continue
    else:
        codeType = int(line[1:3])
        
        #for pause or dwell commands, time is specified directly
        if codeType == 4 or codeType == 5:
            time = float(line[line.find("P", 3, len(line))+1:].split(" ")[0])/1000.0
            TIME_COUNT.append( time )
        
        #for move or line commands, calculate move length and actual feedrate for time
        if codeType == 0 or codeType == 1:
            if "X" in line:
                x_pos = float(line[line.find("X",3,len(line))+1:].split(" ")[0])
            else:
                x_pos = lastPos[0]
            if "Y" in line:
                y_pos = float(line[line.find("Y",3,len(line))+1:].split(" ")[0])
            else:
                y_pos = lastPos[1]
            if "F" in line:
                feed = float(line[line.find("F",3,len(line))+1:].split(" ")[0])
            else:
                feed = lastFeed
            
            newPos = (x_pos, y_pos, 0)
            
            dx = newPos[0] - lastPos[0]
            dy = newPos[1] - lastPos[1]
            
            l = math.sqrt( dx*dx + dy*dy)
            
            if l == 0:
                continue
            
            time_feed = min( feed, determineFeedrate(dx, dy, feed) )
            
            
            time = l / time_feed
            
            TIME_COUNT.append( time )
            
            lastPos = newPos;
            lastFeed = feed;
        
        #for arcs, discretize into line segments and count
        if codeType == 2 or codeType == 3:
            rx = float(line[line.find("I",3,len(line))+1:].split(" ")[0])
            ry = float(line[line.find("J",3,len(line))+1:].split(" ")[0])
            
            x_pos = float(line[line.find("X",3,len(line))+1:].split(" ")[0])
            y_pos = float(line[line.find("Y",3,len(line))+1:].split(" ")[0])
            
            if "F" in line:
                feed = float(line[line.find("F",3,len(line))+1:].split(" ")[0])
            else:
                feed = lastFeed
            
            dx = lastPos[0] - rx
            dy = lastPos[1] - ry
            
            radius = math.sqrt( dx * dx + dy * dy )
            
            angle1 = atan3( dy, dx )
            angle2 = atan3( y_pos - ry, x_pos - rx )
            theta = angle2 - angle1
            
            if codeType == 3 and theta < 0:
                angle2 += 2 * math.pi
            elif codeType == 2 and theta > 0:
                angle1 += 2 * math.pi
            
            theta = angle2 - angle1
            
            l = abs( theta ) * radius
            
            segments = int(math.ceil( l / mm_per_segment ))
            
            for i in range( segments ):
                
                scale = float(i) / float(segments)
                
                angle3 = (theta * scale) + angle1
                nx = rx + math.cos(angle3) * radius
                ny = ry + math.sin(angle3) * radius
                
                newPos = (nx, ny, 0)
                
                dx = newPos[0] - lastPos[0]
                dy = newPos[1] - lastPos[1]
                
                l = math.sqrt( dx*dx + dy*dy)
                
                if l == 0:
                    continue
                
                time_feed = min( feed, determineFeedrate(dx, dy, feed) )
                
                
                time = l / time_feed
                
                TIME_COUNT.append( time )
                
                lastPos = newPos;
                lastFeed = feed;
# ---------- end python_16 ----------
python_17 = PythonScript(CODE=data_7, x_max=panel_6, y_max=panel_7, mm_per_segment=panel_8)  # -> out, TIME_COUNT; inputs CODE: list; disabled; same code as python_16
python_18 = PythonScript(CODE=python_14.newCode, x_max="300.0", y_max="80.0", mm_per_segment="1.0")  # -> out, newCode, TIME_COUNT, TIME_TOTAL; inputs CODE: list
# ---------- python_18: Python ----------
import math

lastPos = (0,0,0)
lastFeed = 50.0

TIME_COUNT = []
newCode = []

def determineFeedrate(dx, dy, f):
    vec = math.sqrt( dx*dx + dy*dy )
    vx = min( x_max, f * dx / vec)
    vy = min( y_max, f * dy / vec)
    return math.sqrt( vx * vx + vy * vy )

def atan3( dy, dx ):
    a = math.atan2( dy, dx )
    if a < 0 :
        a += math.pi * 2.0
    return a

for line in CODE:
    #skip first line
    if line[0] == "N":
        if "G" in line:
            codeType = int(line[line.find("G")+1:].split(" ")[0])
            #print codeType
            
            #for pause or dwell commands, time is specified directly
            if codeType == 4 or codeType == 5:
                time = float(line[line.find("P", 3, len(line))+1:].split(" ")[0])/1000.0
                TIME_COUNT.append( time )
            
            #for move or line commands, calculate move length and actual feedrate for time
            if codeType == 0 or codeType == 1:
                if "X" in line:
                    x_pos = float(line[line.find("X",3,len(line))+1:].split(" ")[0])
                else:
                    x_pos = lastPos[0]
                if "Y" in line:
                    y_pos = float(line[line.find("Y",3,len(line))+1:].split(" ")[0])
                else:
                    y_pos = lastPos[1]
                if "F" in line:
                    feed = float(line[line.find("F",3,len(line))+1:].split(" ")[0])
                else:
                    feed = lastFeed
                
                newPos = (x_pos, y_pos, 0)
                
                dx = newPos[0] - lastPos[0]
                dy = newPos[1] - lastPos[1]
                
                l = math.sqrt( dx*dx + dy*dy)
                
                if l == 0:
                    TIME_COUNT.append( 0 )
                    continue
                
                time_feed = min( feed, determineFeedrate(dx, dy, feed) )
                
                
                time = l / time_feed
                
                TIME_COUNT.append( time )
                
                lastPos = newPos;
                lastFeed = feed;
            
            #for arcs, discretize into line segments and count
            if codeType == 2 or codeType == 3:
                arcTime = []
                rx = float(line[line.find("I",3,len(line))+1:].split(" ")[0])
                ry = float(line[line.find("J",3,len(line))+1:].split(" ")[0])
                
                x_pos = float(line[line.find("X",3,len(line))+1:].split(" ")[0])
                y_pos = float(line[line.find("Y",3,len(line))+1:].split(" ")[0])
                
                if "F" in line:
                    feed = float(line[line.find("F",3,len(line))+1:].split(" ")[0])
                else:
                    feed = lastFeed
                
                dx = lastPos[0] - rx
                dy = lastPos[1] - ry
                
                radius = math.sqrt( dx * dx + dy * dy )
                
                angle1 = atan3( dy, dx )
                angle2 = atan3( y_pos - ry, x_pos - rx )
                theta = angle2 - angle1
                
                if codeType == 3 and theta < 0:
                    angle2 += 2 * math.pi
                elif codeType == 2 and theta > 0:
                    angle1 += 2 * math.pi
                
                theta = angle2 - angle1
                
                l = abs( theta ) * radius
                
                segments = int(math.ceil( l / mm_per_segment ))
                
                for i in range( segments ):
                    
                    scale = float(i) / float(segments)
                    
                    angle3 = (theta * scale) + angle1
                    nx = rx + math.cos(angle3) * radius
                    ny = ry + math.sin(angle3) * radius
                    
                    newPos = (nx, ny, 0)
                    
                    dx = newPos[0] - lastPos[0]
                    dy = newPos[1] - lastPos[1]
                    
                    l = math.sqrt( dx*dx + dy*dy)
                    
                    if l == 0:
                        continue
                    
                    time_feed = min( feed, determineFeedrate(dx, dy, feed) )
                    
                    
                    time = l / time_feed
                    
                    arcTime.append( time )
                    
                    lastPos = newPos;
                    lastFeed = feed;
                TIME_COUNT.append( sum(arcTime) )
                
        else:
            TIME_COUNT.append( 0 )
    else:
        TIME_COUNT.append( 0 )

TIME_TOTAL = sum(TIME_COUNT)

for i, line in enumerate(CODE):
    timeLeft = TIME_TOTAL - sum(TIME_COUNT[:i])
    timeStamp = "%02i:%02i" %(timeLeft/60, timeLeft%60)
    newCode.append( line + " *" + timeStamp )
# ---------- end python_18 ----------
python_19 = PythonScript(CODE=python_15.newCode, x_max="300.0", y_max="80.0", mm_per_segment="1.0")  # -> out, newCode, TIME_COUNT, TIME_TOTAL; inputs CODE: list; same code as python_18
ma = MassAddition(Input=python_18.TIME_COUNT)  # -> Result, PartialResults; disabled
ma_2 = MassAddition(Input=python_19.TIME_COUNT)  # -> Result, PartialResults; disabled
panel_9 = Panel("0")  # disabled
panel_10 = Panel("0")  # disabled
panel_11 = Panel("0")  # disabled
panel_12 = Panel("0")  # disabled
time = ConstructTime(Hour=panel_11, Minute=panel_11, Second=ma.Result)  # disabled
time_2 = ConstructTime(Hour=panel_12, Minute=panel_12, Second=ma_2.Result)  # disabled
panel_13 = Panel(time)  # disabled
panel_14 = Panel(time_2)  # disabled
path_3 = FilePath(path)
int_10 = Integer(lng)
int_11 = Integer(int_4)

# ---- group: PREPEND / APPEND POSITIONING CODE
init_positioning = Panel("""G0 X0 Y-50 F50.0
G05 P3000.0""")
final_positioning = Panel("""G00 Y-50 F200.0
M51
G04 P6000.0
G0 X0
G0 X0 Y0""")
init_positioning_2 = Panel("""G00 X1985 Y0 F300.0
G00 Y-50.0
G05 P3000.0""")
final_positioning_2 = Panel("""G00 Y-50 F200.0
M51
G04 P6000.0
G0 X0
G0 X0 Y0""")
merge_9 = Merge(Data1=flatten(init_positioning), Data2=flatten(python_7.GCODE), Data3=flatten(final_positioning))  # -> flatten(Result)
merge_10 = Merge(Data1=flatten(init_positioning_2), Data2=flatten(python_8.GCODE), Data3=flatten(final_positioning_2))  # -> flatten(Result)

# ----
dispatch_3 = Dispatch(List=merge_9, DispatchPattern=null.NullFlags)  # -> ListA, ListB
dispatch_4 = Dispatch(List=merge_10, DispatchPattern=null_2.NullFlags)  # -> ListA, ListB

# ---- group: PREPEND / APPEND POSITIONING CODE (continued)
merge_11 = Merge(Data1=flatten(concat_2), Data2=flatten("$$L BLAST$$"), Data3=flatten(dispatch_3.ListB))  # -> flatten(Result)
merge_12 = Merge(Data1=flatten(concat_2), Data2=flatten("$$R BLAST$$"), Data3=flatten(dispatch_4.ListB))  # -> flatten(Result)

# ----
data_10 = Data(merge_11)
data_11 = Data(merge_12)
python_20 = PythonScript(code=data_10)  # -> out, newCode; inputs code: list; same code as python_14
python_21 = PythonScript(code=data_11)  # -> out, newCode; inputs code: list; same code as python_14
python_22 = PythonScript(CODE=data_10, x_max=panel_6, y_max=panel_7, mm_per_segment=panel_8)  # -> out, TIME_COUNT; inputs CODE: list; disabled
# ---------- python_22: Python ----------
import math

lastPos = (0,0,0)
lastFeed = 50.0

TIME_COUNT = []

def determineFeedrate(dx, dy, f):
    vec = math.sqrt( dx*dx + dy*dy )
    vx = min( x_max, f * dx / vec)
    vy = min( y_max, f * dy / vec)
    return math.sqrt( vx * vx + vy * vy )

def atan3( dy, dx ):
    a = math.atan2( dy, dx )
    if a < 0 :
        a += math.pi * 2.0
    return a

for line in CODE:
    #skip first line
    if line[0] == '$':
        continue
    else:
        codeType = int(line[1:3])
        
        #for pause or dwell commands, time is specified directly
        if codeType == 4 or codeType == 5:
            time = float(line[line.find("P", 3, len(line))+1:].split(" ")[0])/1000.0
            TIME_COUNT.append( time )
        
        #for move or line commands, calculate move length and actual feedrate for time
        if codeType == 0 or codeType == 1:
            if "X" in line:
                x_pos = float(line[line.find("X",3,len(line))+1:].split(" ")[0])
            else:
                x_pos = lastPos[0]
            if "Y" in line:
                y_pos = float(line[line.find("Y",3,len(line))+1:].split(" ")[0])
            else:
                y_pos = lastPos[1]
            if "F" in line:
                feed = float(line[line.find("F",3,len(line))+1:].split(" ")[0])
            else:
                feed = lastFeed
            
            newPos = (x_pos, y_pos, 0)
            
            dx = newPos[0] - lastPos[0]
            dy = newPos[1] - lastPos[1]
            
            l = math.sqrt( dx*dx + dy*dy)
            
            if l == 0:
                continue
            
            feed = min( feed, determineFeedrate(dx, dy, feed) )
            
            
            time = l / feed
            
            TIME_COUNT.append( time )
            
            lastPos = newPos;
            lastFeed = feed;
        
        #for arcs, discretize into line segments and count
        if codeType == 2 or codeType == 3:
            rx = float(line[line.find("I",3,len(line))+1:].split(" ")[0])
            ry = float(line[line.find("J",3,len(line))+1:].split(" ")[0])
            
            x_pos = float(line[line.find("X",3,len(line))+1:].split(" ")[0])
            y_pos = float(line[line.find("Y",3,len(line))+1:].split(" ")[0])
            
            dx = lastPos[0] - rx
            dy = lastPos[1] - ry
            
            radius = math.sqrt( dx * dx + dy * dy )
            
            angle1 = atan3( dy, dx )
            angle2 = atan3( y_pos - ry, x_pos - rx )
            theta = angle2 - angle1
            
            if codeType == 3 and theta < 0:
                angle2 += 2 * math.pi
            elif codeType == 2 and theta > 0:
                angle1 += 2 * math.pi
            
            theta = angle2 - angle1
            
            l = abs( theta ) * radius
            
            for i in range( math.ceil( l / mm_per_segment ) ):
                print i
# ---------- end python_22 ----------
python_23 = PythonScript(CODE=data_11, x_max=panel_6, y_max=panel_7, mm_per_segment=panel_8)  # -> out, TIME_COUNT; inputs CODE: list; disabled; same code as python_22
python_24 = PythonScript(CODE=python_20.newCode, x_max="300.0", y_max="80.0", mm_per_segment="1.0")  # -> out, newCode, TIME_COUNT, TIME_TOTAL; inputs CODE: list; same code as python_18
python_25 = PythonScript(CODE=python_21.newCode, x_max="300.0", y_max="80.0", mm_per_segment="1.0")  # -> out, newCode, TIME_COUNT, TIME_TOTAL; inputs CODE: list; same code as python_18
ma_3 = MassAddition(Input=python_24.TIME_COUNT)  # -> Result, PartialResults; disabled
ma_4 = MassAddition(Input=python_25.TIME_COUNT)  # -> Result, PartialResults; disabled
time_3 = ConstructTime(Hour=panel_9, Minute=panel_9, Second=ma_3.Result)  # disabled
time_4 = ConstructTime(Hour=panel_10, Minute=panel_10, Second=ma_4.Result)  # disabled
panel_15 = Panel(time_3)  # disabled
panel_16 = Panel(time_4)  # disabled
addition_2 = Addition(A=python_24.TIME_TOTAL, B=python_25.TIME_TOTAL, C=python_18.TIME_TOTAL, D=python_19.TIME_TOTAL)
python_26 = PythonScript(
    entries=int_10,
    fp=path_3,
    slotID=int_11,
    boardLabel=data_5,
    L_clean=python_18.TIME_TOTAL,
    L_blast=python_24.TIME_TOTAL,
    R_clean=python_19.TIME_TOTAL,
    R_blast=python_25.TIME_TOTAL,
    total_time=addition_2)  # -> out, a; inputs entries: Int32, slotID: Int32
# ---------- python_26: Python ----------
file = "time_est_10mm-sec.csv"

header = "slotID,board,L clean,L blast,R clean,R blast,total \n"
data = [ "NONE \n" for i in range(entries+1) ]

#line = "%d,%s,%s \n" %(slotID, boardLabel[3:],L_clean)

#print line

with open( fp + file, mode="r" ) as f:
    for i, line in enumerate(f.readlines() ):
        data[i] = line
f.close()

data[0] = header

line = "%d,%s,%.2f,%.2f,%.2f,%.2f,%.2f \n" %(slotID, boardLabel[3:],L_clean,L_blast,R_clean,R_blast,total_time)
data[slotID+1] = line

with open( fp + file, mode="w" ) as f:
    for entry in data:
        f.write(entry)
        
f.close()
# ---------- end python_26 ----------
