# Grasshopper definition 160520_blasting_generator [May-23 '16, 1057].gh (Grasshopper 0.9.76)
# plug-ins: MeshEdit Components, Python Interpreter, HDTReference

panel = Panel("C:\Users\james\Desktop\Box Sync\THE_LIVING\1510_PSoA_SCAFFOLDING\03_WORK\160505_parse data\02_processed\")
end_offset_mm = Slider(0, range=-150..150)
start_offset_mm = Slider(0, range=-150..150)
board_label = Panel("D-46")
board_section = Panel("1")
board_width_mm = Panel("235")
start_offset = Number(start_offset_mm)
num = Number(end_offset_mm)
python = PythonScript()  # -> path
# ---------- python: Python ----------
import sys
sys.path.append(path)

path = ghenv.LocalScope.ghdoc.Path
path = path.split("\\")
path = "\\".join(path[:-1]) + "\\"
# ---------- end python ----------
merge = Merge(Data1=panel, Data2=board_label, Data3="_dilated_24.png")
merge_2 = Merge(Data1=panel, Data2=board_label, Data3="_resized.png")
panel_2 = Panel("south_cut_lengths.json")

# ---- group: blob path
join = TextJoin(Text=merge)

# ---- group: rgb path
join_2 = TextJoin(Text=merge_2)

# ----
concat = Concatenate(FragmentA=board_label, FragmentB=board_section, JoinSeparator=" #")
subtraction = Subtraction(A=board_section, B=1)
panel_3 = Panel(python)
img = ImportImage(File=join)
merge_3 = Merge(Data1=python, Data2="cut_data_by_length.json")

# ---- group: mesh resolution dropdown
bbox = BoundingBox(Content=img, Plane=PlaneXY(0, 0, 0))  # -> Box, Box_2
debox = DeconstructBox(Box=bbox.Box_2)  # -> Plane, X, Y, Z
number_slider = Slider(1, range=1..5)
dedomain = DeconstructDomain(Domain=debox.X)  # -> Start, End
dedomain_2 = DeconstructDomain(Domain=debox.Y)  # -> Start, End
division = Division(A=dedomain.End, B=number_slider)
division_2 = Division(A=dedomain_2.End, B=number_slider)
img_2 = ImportImage(File=join_2, XSamples=division, YSamples=division_2)

# ----
join_3 = TextJoin(Text=merge_3)
file = ReadFile(File=join_3, PerLineParse=False)

# ---- group: VISUALIZE CUT LOCATIONS
ft_mm = Panel("304.8")
python_2 = PythonScript(data=file, boardID=board_label)  # -> out, a
# ---------- python_2: Python ----------
import json

a = []

d = json.loads(data)

lengths = d[boardID]

sum = 0

for l in lengths:
    sum += l
    a.append(sum)
# ---------- end python_2 ----------
Y = UnitY(Factor=1)
pt = ConstructPoint(XCoordinate=0, YCoordinate=0, ZCoordinate=0)
multiplication = Multiplication(A=python_2.a, B=ft_mm)
line = LineSDL(Start=pt, Direction=Y, Length=board_width_mm)
X = UnitX(Factor=multiplication)
move = Move(Geometry=line, Motion=X)  # -> Geometry, Transform
previewlw = CustomPreviewLineweights(Geometry=move.Geometry, Shader=ColourSwatch(SwatchColor=RGB(0, 0, 0)), Thickness=Slider(5, range=0..10))

# ----
division_3 = Division(A=board_width_mm, B=dedomain_2.End)

# ---- group: blob mesh
scale = Scale(Geometry=img, Center=Point(0, 0, 0), Factor=division_3)  # -> Geometry, Transform

# ---- group: rgb mesh
scale_2 = Scale(Geometry=img_2, Center=Point(0, 0, 0), Factor=division_3)  # -> Geometry, Transform

# ----
bbox_2 = BoundingBox(Content=scale.Geometry, Plane=PlaneXY(0, 0, 0))  # -> Box, Box_2
final_mesh = Mesh(scale.Geometry)
blast_spacing_mm = Slider(10, range=5..20)
debox_2 = DeconstructBox(Box=bbox_2.Box_2)  # -> Plane, X, Y, Z
dedomain_3 = DeconstructDomain(Domain=debox_2.Y)  # -> Start, End
dedomain_4 = DeconstructDomain(Domain=debox_2.X)  # -> Start, End
division_4 = Division(A=dedomain_4.End, B=blast_spacing_mm)
division_5 = Division(A=dedomain_3.End, B=blast_spacing_mm)

# ---- group: dim stringers
y_bound = Number(dedomain_3.End)
x_bound = Number(dedomain_4.End)
dim_stringers = DimStringers(offset="-30", scale=Slider(10, range=0..10), x_bound=x_bound, y_bound=y_bound)

# ----
recgrid = Rectangular(Plane=PlaneXY(0, 0, 0), SizeX=blast_spacing_mm, SizeY=blast_spacing_mm, ExtentX=division_4, ExtentY=division_5)  # -> Cells, flatten(Points)
final_mesh_2 = Mesh(final_mesh)
sample_points = Point(recgrid.Points)
demesh = DeconstructMesh(Mesh=final_mesh_2)  # -> Vertices, Faces, Colours, Normals
meshcp = MeshClosestPoint(Point=sample_points, Mesh=final_mesh_2)  # -> Point, Index, Parameter
deface = DeconstructFace(Face=demesh.Faces)  # -> CornerA, CornerB, CornerC, CornerD
item = ListItem(List=deface.CornerA, Index=meshcp.Index, Wrap=True)
item_2 = ListItem(List=demesh.Colours, Index=item, Wrap=True)
argb = SplitARGB(Colour=item_2)  # -> Alpha, Red, Green, Blue
larger = LargerThan(FirstNumber=argb.Red, SecondNumber="0")  # -> LargerThan, OrEqualTo

# ---- group: all points
pt_2 = Point(sample_points)

# ----
dispatch = Dispatch(List=pt_2, DispatchPattern=larger.LargerThan)  # -> ListA, ListB

# ---- group: cut values
num_2 = Number(multiplication)

# ---- group: knot points
pt_3 = Point(dispatch.ListA)

# ---- group: board section
num_3 = Number(subtraction)

# ----
merge_4 = Merge(Data1=flatten("0"), Data2=flatten(num_2))
num_4 = Number(num)
num_5 = Number(start_offset)
python_3 = PythonScript(points=pt_3, cuts=merge_4, section=num_3, startShift=num_5, endShift=num_4)  # -> out, startCut, endCut, split_pts; inputs points: list, cuts: list
# ---------- python_3: Python ----------
import rhinoscriptsyntax as rs

split_pts = []

startCut = max(cuts[int(section)] + startShift, 0)
endCut = cuts[int(section)+1] + endShift

for pt in points:
    p = rs.coerce3dpoint(pt)
    
    if p.X > startCut and p.X < endCut:
        split_pts.append(p)
        continue
# ---------- end python_3 ----------
blast_spacing = Number(blast_spacing_mm)
pt_4 = ConstructPoint(XCoordinate=python_3.startCut, YCoordinate=0, ZCoordinate=0)
pt_5 = ConstructPoint(XCoordinate=python_3.endCut, YCoordinate=0, ZCoordinate=0)
multiplication_2 = Multiplication(A=blast_spacing, B="2")
pt_6 = Point(pt_4)
pt_7 = Point(pt_5)

# ---- group: ISOLATE BLAST AREA BOUNDARY
pt_8 = Point(python_3.split_pts)
del = DelaunayMesh(Points=pt_8, Plane=PlaneXY(0, 0, 0))
faceb = FaceBoundaries(Mesh=del)
len = Length(Curve=faceb)
larger_2 = LargerThan(FirstNumber=len, SecondNumber="45")  # -> LargerThan, OrEqualTo
cullf = CullFaces(Mesh=del, Pattern=larger_2.LargerThan)
disjoint = DisjointMesh(Mesh=cullf)
nakededge = MeshNakedEdge(Mesh=disjoint)  # -> V, A, B
item_3 = ListItem(List=nakededge.V, Index=nakededge.A, Wrap=True)
item_4 = ListItem(List=nakededge.V, Index=nakededge.B, Wrap=True)
ln = Line(StartPoint=item_3, EndPoint=item_4)
join_4 = JoinCurves(Curves=ln, Preserve=False)  # -> flatten(Curves)

# ---- group: VISUALIZE CUT LOCATION
Y_2 = UnitY(Factor=1)
line_2 = LineSDL(Start=pt_6, Direction=Y_2, Length=board_width_mm)
previewlw_2 = CustomPreviewLineweights(Geometry=line_2, Shader=ColourSwatch(SwatchColor=RGB(255, 0, 0)), Thickness=Slider(5, range=0..10))

# ---- group: VISUALIZE KNOT BOUNDARY
panel_4 = Panel("""0.1
3""")
swatch = ColourSwatch(SwatchColor=RGB(255, 255, 31))
dash = DashPattern(Curve=join_4, Pattern=panel_4)  # -> Dashes, Gaps
previewlw_3 = CustomPreviewLineweights(Geometry=dash.Dashes, Shader=swatch, Thickness=Slider(4, range=0..10))

# ----
cleaning_zone_overlap = Panel("100")
max_blast_width = Panel("1985")
flex_zone = Panel("600")
pt_9 = Point(pt_6)
pt_10 = Point(pt_7)

# ---- group: DIRECITONAL WEIGHTING
number_slider_2 = Slider(2, range=0.5..2)
number_slider_3 = Slider(1, range=0..1)
number_slider_4 = Slider(2000, range=0..10000)

# ----
python_4 = PythonScript(
    startPt=pt_9,
    endPt=pt_10,
    blob=join_4,
    height=board_width_mm,
    width=max_blast_width,
    flex=flex_zone,
    overlap=cleaning_zone_overlap)  # -> out, zones, blob_1, blastPt_1, blob_2, blastPt_2; inputs startPt: Point3d, endPt: Point3d, blob: list of Curve
# ---------- python_4: Python ----------
import rhinoscriptsyntax as rs
import math

blastPt_1 = []
blob_1 = []
blastPt_2 = []
blob_2 = []
zones = []
a=[]

l_max = 0
r_min = 10000.0

#function to fill blob with point grid
def fillBlob( crv ):
    #output points
    outPts = []
    #extract control points of boundary curve
    cP = rs.CurvePoints(crv)
    x_step = 1000.0
    y_step = 1000.0
    x_min = 10000.0
    x_max = 0
    y_min = 100000.0
    y_max = 0
    for i, pt in enumerate(cP):
        x_min = min(pt.X, x_min)
        x_max = max(pt.X, x_max)
        y_min = min(pt.Y, y_min)
        y_max = max(pt.Y, y_max)
        if i > 0:
            if abs(pt.X - cP[i-1].X) > 0:
                x_step = min( x_step, abs(pt.X - cP[i-1].X))
            if abs(pt.Y - cP[i-1].Y) > 0:
                y_step = min( y_step, abs(pt.Y - cP[i-1].Y))

    
    for y in range( int((y_max-y_min)/y_step ) + 1):
        for x in range( int((x_max-x_min)/x_step) + 1):
            #print "Point @ (" + str(x) + ", " + str(y) + ")"
            newPt = rs.AddPoint((x_min + x_step*x,y_min + y_step*y,0))
            a.append(newPt)
            if rs.PointInPlanarClosedCurve( newPt, crv ):
                outPts.append(newPt)
    
    return outPts

#demarcate blast sections
if endPt.X - startPt.X < width:
    zones.append( rs.AddPolyline([startPt, (startPt.X + width,0,0), (startPt.X + width,height,0), (startPt.X, height,0), startPt]))
else:
    zones.append( rs.AddPolyline([startPt, (width,0,0), (width,height,0), (0, height,0), startPt]))
    zones.append( rs.AddPolyline([endPt, (endPt.X-width,0,0), (endPt.X-width, height,0), (endPt.X, height, 0), endPt]))

for crv in blob:
    #check if centroid is within L half
    centroid = rs.CurveAreaCentroid(crv)[0]
    cP = rs.CurvePoints(crv)
    max_x = max([pt[0] for pt in cP])
    min_x = min([pt[0] for pt in cP])
    
    #check if board board is too long for single pass
    if endPt.X - startPt.X < width:
        blob_1.append( crv )
        blastPt_1.extend( fillBlob(crv) )
        l_max = max( l_max, max_x )
        continue
    
    
    #check if blob is closer to left
    if max_x < startPt.X + width:
        #check if in L "safe" zone
        if max_x < (startPt.X + width - flex):
            blob_1.append( crv )
            blastPt_1.extend( fillBlob(crv) )
            l_max = max( l_max, max_x )
            continue
        #not in safe zone
        else:
            #check if blob is completely within L flex zone
            if max_x < startPt.X + width:
                blob_1.append( crv )
                blastPt_1.extend( fillBlob(crv) )
                l_max = max( l_max, max_x )
                continue
    
    #check if blob is closer to right
    elif min_x > endPt.X - width:
        #check if in R "safe" zone
        if min_x > endPt.X - width - flex:
            blob_2.append(crv)
            blastPt_2.extend( fillBlob(crv) )
            r_min = min( r_min, min_x )
            continue
        #check if completely within R flex zone
        if min_x > endPt.X - width:
            blob_2.append(crv)
            blastPt_2.extend( fillBlob(crv) )
            r_min = min( r_min, min_x )
            continue
    #blob straddles boundary and must be split
    else:
        l_half = rs.CurveBooleanIntersection(zones[0],crv)
        r_half = rs.CurveBooleanIntersection(zones[1],crv)
        
        blob_1.append( l_half )
        blastPt_1.extend( fillBlob(l_half) )
        blob_2.append( r_half )
        blastPt_2.extend( fillBlob(r_half) )

if len(zones) > 1:
    if len(blastPt_2) < 1:
        l_max = width
        r_min = l_max
    split_x = (r_min - l_max)/2.0 + l_max
else:
    split_x = endPt.X

#shift ends of zones to split
#shift zone 0 points left
z_pt = rs.CurvePoints( zones[0] )

z_pt[1].X = min(split_x + overlap, startPt.X + width)
z_pt[2].X = min(split_x + overlap, startPt.X + width)

zones[0] = rs.AddPolyline( z_pt )
if len(zones) > 1:
    #shift zone 1 points right
    z_pt = rs.CurvePoints( zones[1] )
    z_pt[1].X = split_x - overlap
    z_pt[2].X = split_x - overlap
    
    zones[1] = rs.AddPolyline( z_pt )
# ---------- end python_4 ----------
python_5 = PythonScript(zones=python_4.zones, machineWidth=max_blast_width, spacing="20.0", cleanSpeed="300.0")  # -> out, a, GCODE; inputs zones: Curve
# ---------- python_5: Python ----------
import rhinoscriptsyntax as rs
import math

cP = rs.CurvePoints( zones )
a = []
GCODE = []

def genGCODE( code, inputs ):
    line = "G0" + str(code)
    if code == 2 or code == 3:
        line += " I" + str(round(inputs[0]-x_offset,3)) + " J" + str(round(inputs[1],3))
        line += " X" + str(round(inputs[2]-x_offset,3)) + " Y" + str(round(inputs[3],3))
        line += " F" + str(round(inputs[4],3))
    elif code == 0 or code == 1:
        line += " X" + str(round(inputs[0]-x_offset,3)) + " Y" + str(round(inputs[1],3))
        line += " F" + str(round(inputs[2],3))
    elif code == 4 or code == 5:
        line += " P" + str(round(inputs[0],3))
    else:
        return
    GCODE.append(line)

#determine start and initial direction from L or R sections
startX = cP[0].X
#left side

if cP[0].X < cP[1].X:
    dir = 1.0
    x_offset = startX
#right side
else:
    dir = -1.0
    x_offset = startX - machineWidth
    print x_offset

#connecting arc radius
r = spacing*0.5

#zone dimensions
width = abs(cP[0].X - cP[1].X) - spacing
height = abs(cP[1].Y - cP[2].Y)

#calculate number of passes at spacing and start offset
passes = int(math.ceil(height/spacing))
startH = ((passes*spacing) - height)/-2

def genArc( firstPt, secondPt, radius, direction ):
    arcCenter = ( firstPt[0], (secondPt[1] - firstPt[1])/2.0 + firstPt[1], 0)
    arcDir = (arcCenter[0] + direction, arcCenter[1], 0)
    arcPlane = rs.PlaneFromPoints(arcCenter, firstPt, arcDir)
    #gen gcode
    if direction > 0:
        genGCODE(2,[arcCenter[0],arcCenter[1],secondPt[0],secondPt[1], cleanSpeed])
    else:
        genGCODE(3,[arcCenter[0],arcCenter[1],secondPt[0],secondPt[1], cleanSpeed])
    return rs.AddArc(arcPlane, radius, -180 * abs(dir)) 

#generate starting point
startPt = (startX + dir*r, startH - spacing, 0)

#gen GCODE to move to start position
genGCODE( 0, [startPt[0],-50, cleanSpeed])
#gcode to start blast stream
genGCODE( 5, [3000.0] )
genGCODE( 1, [startPt[0],startPt[1], cleanSpeed])

endPt = (startPt[0], startH, 0)
a.append( genArc( startPt, endPt, r, dir ) )

for i in range( passes + 1 ):
    flip = 1 - 2*(i%2)
    start = (startX + dir*r*flip + dir*(width+spacing)*(i%2), startH + spacing*i,0)
    end = (start[0] + dir*flip*width, start[1], 0)
    a.append( rs.AddLine(start,end) )
    genGCODE(1,[end[0],end[1],cleanSpeed])
    
    nextPt = (end[0],end[1]+spacing,0)
    a.append( genArc( end, nextPt, r, -dir*flip ) )

if nextPt[1] < height+50:
    genGCODE(0,[nextPt[0],height+50,cleanSpeed])

genGCODE(4,[6000.0])
GCODE.append( "G00 X0" )
GCODE.append( "G00 Y0" )
# ---------- end python_5 ----------
crv = Curve(python_4.zones)
data = Data(concat)
python_6 = PythonScript(points=python_4.blastPt_1, startPoint=pt_9, startX="0", err=multiplication_2, xWeight=number_slider_2)  # -> out, GCODE, lines_00, lines_01; inputs points: list
# ---------- python_6: Python ----------
import rhinoscriptsyntax as rs
import scriptcontext as sc
import Rhino
import random
import math

sc.doc = ghdoc

moveRef = rs.coerce3dpoint(startPoint)

def gen_GCODE(pt, code):
    if code == 1:
        feed = 5.0
    else:
        feed = 300.0
    return "G01" + " X" + str(round(startX + pt[0] - moveRef.X, 3)) + " Y" + str(round(pt[1], 3)) + " F" + str(feed)
    
def linearDistance(p1, p2):
    return math.sqrt((p2[0]-p1[0])**2 + xWeight * (p2[1]-p1[1])**2)

#err = 15.00
endPoints = []
lines_00 = []
lines_01 = []
GCODE = []

for point in points:
    pt = rs.coerce3dpoint(point)
    endPoints.append([pt.X, pt.Y])

if startPoint is None:
    curr_Point = endPoints.pop(random.choice(range(len(endPoints))))
    GCODE.append( gen_GCODE(curr_Point, 0) )
else:
    sp = rs.coerce3dpoint(startPoint)
    curr_Point = [sp.X, sp.Y]

for i in range(len(endPoints)):
    closest = 0
#    dir = 0
    minDist = float("inf")
    
    for j in range(len(endPoints)):
        pt = endPoints[j]
        dist = linearDistance(curr_Point, pt)
        if dist < minDist:
            closest = j
#            dir = k
            minDist = dist
    
    next_Point = endPoints.pop(closest)
    
    if minDist > err:
        GCODE.append( gen_GCODE(next_Point, 0) )
        lines_00.append(rs.AddLine(rs.AddPoint(curr_Point[0], curr_Point[1], 0), rs.AddPoint(next_Point[0], next_Point[1], 0)))
    else:
        GCODE.append( gen_GCODE(next_Point, 1) )
        lines_01.append(rs.AddLine(rs.AddPoint(curr_Point[0], curr_Point[1], 0), rs.AddPoint(next_Point[0], next_Point[1], 0)))
    
    curr_Point = next_Point
    
print GCODE

#trigger = True
# ---------- end python_6 ----------
python_7 = PythonScript(points=python_4.blastPt_2, startPoint=pt_10, startX=max_blast_width, err=multiplication_2, xWeight=number_slider_2)  # -> out, GCODE, lines_00, lines_01; inputs points: list; same code as python_6
concat_2 = Concatenate(FragmentA="$$ ", FragmentB=data)

# ---- group: VISUALIZE CLEANING PATH
panel_5 = Panel("""2
6""")
dash_2 = DashPattern(Curve=python_5.a, Pattern=panel_5)  # -> Dashes, Gaps
previewlw_4 = CustomPreviewLineweights(Geometry=dash_2.Dashes, Shader=ColourSwatch(SwatchColor=RGB(0, 0, 31)), Thickness=Slider(2.5, range=0..10))

# ---- group: VISUALIZE PATH
swatch_2 = ColourSwatch(SwatchColor=RGB(0, 149, 255))
swatch_3 = ColourSwatch(SwatchColor=RGB(255, 0, 0))
geo = Geometry(python_6.lines_00)
geo_2 = Geometry(python_6.lines_01)
geo_3 = Geometry(python_7.lines_01)
geo_4 = Geometry(python_7.lines_00)
preview = CustomPreview(Geometry=geo, Shader=swatch_2)
previewlw_5 = CustomPreviewLineweights(Geometry=geo_2, Shader=swatch_3, Thickness=Slider(3, range=0..10))
preview_2 = CustomPreview(Geometry=geo_4, Shader=ColourSwatch(SwatchColor=RGB(0, 149, 255)))
previewlw_6 = CustomPreviewLineweights(Geometry=geo_3, Shader=ColourSwatch(SwatchColor=RGB(255, 0, 0)), Thickness=Slider(3, range=0..10))

# ----
null = NullItem(Item=python_6.GCODE)  # -> NullFlags, InvalidFlags, Description
null_2 = NullItem(Item=python_7.GCODE)  # -> NullFlags, InvalidFlags, Description
geo_5 = Geometry(python_4.blob_1)
col = Colour(swatch)
geo_6 = Geometry(python_4.blob_2)
col_2 = Colour(swatch)

# ---- group: CALCULATE BLASTING TIME ESTIMATE
len_2 = Length(Curve=geo)
len_3 = Length(Curve=geo_2)
len_4 = Length(Curve=geo_4)
len_5 = Length(Curve=geo_3)
ma = MassAddition(Input=len_2)  # -> Result, PartialResults
ma_2 = MassAddition(Input=len_3)  # -> Result, PartialResults
ma_3 = MassAddition(Input=len_4)  # -> Result, PartialResults
ma_4 = MassAddition(Input=len_5)  # -> Result, PartialResults
division_6 = Division(A=ma.Result, B="300")
division_7 = Division(A=ma_2.Result, B="10")
division_8 = Division(A=ma_3.Result, B="300")
division_9 = Division(A=ma_4.Result, B="10")
addition = Addition(A=division_6, B=division_7)
addition_2 = Addition(A=division_8, B=division_9)
division_10 = Division(A=addition, B="60")
mod = Modulus(A=addition, B="60")
division_11 = Division(A=addition_2, B="60")
mod_2 = Modulus(A=addition_2, B="60")
round = Round(Number=division_10)  # -> Nearest, Floor, Ceiling
round_2 = Round(Number=mod)  # -> Nearest, Floor, Ceiling
round_3 = Round(Number=division_11)  # -> Nearest, Floor, Ceiling
round_4 = Round(Number=mod_2)  # -> Nearest, Floor, Ceiling
time = ConstructTime(Hour=0, Minute=round.Floor, Second=round_2.Ceiling)
time_2 = ConstructTime(Hour=0, Minute=round_3.Floor, Second=round_4.Ceiling)

# ----
lng = ListLength(List=geo_5)
lng_2 = ListLength(List=geo_6)

# ---- group: ADD LABEL HEADER
data_2 = Data(data)
bang = ExplodeTree(Data=python_5.GCODE)  # -> _0000, _0001
concat_3 = Concatenate(FragmentA="$$ ", FragmentB=data_2)
merge_5 = Merge(Data1=flatten(concat_3), Data2=flatten(bang._0001))  # -> flatten(Result)
merge_6 = Merge(Data1=flatten(concat_3), Data2=flatten(bang._0000))  # -> flatten(Result)

# ----
dup = DuplicateData(Data=col, Number=lng, Order=True)
dup_2 = DuplicateData(Data=col_2, Number=lng_2, Order=True)

# ---- group: OUTPUT SVG FOR VISUALIZATION
geo_7 = Geometry(geo)
col_3 = Colour(swatch_2)
geo_8 = Geometry(geo_2)
col_4 = Colour(swatch_3)
geo_9 = Geometry(geo_4)
col_5 = Colour(swatch_2)
geo_10 = Geometry(geo_3)
col_6 = Colour(swatch_3)
lng_3 = ListLength(List=geo_7)
lng_4 = ListLength(List=geo_8)
lng_5 = ListLength(List=geo_9)
lng_6 = ListLength(List=geo_10)
bang_2 = ExplodeTree(Data=graft(python_4.zones))  # -> _0000, _0001
dup_3 = DuplicateData(Data=col_3, Number=lng_3, Order=True)
dup_4 = DuplicateData(Data=col_4, Number=lng_4, Order=True)
dup_5 = DuplicateData(Data=col_5, Number=lng_5, Order=True)
dup_6 = DuplicateData(Data=col_6, Number=lng_6, Order=True)
number_slider_5 = Slider(3, range=0..10)
toggle = BooleanToggle(True)
merge_7 = Merge(Data1=flatten(bang_2._0000), Data2=flatten(geo_5), Data3=flatten(geo_7), Data4=flatten(geo_8))
merge_8 = Merge(Data1=flatten("BLACK"), Data2=flatten(dup), Data3=flatten(dup_3), Data4=flatten(dup_4))
merge_9 = Merge(Data1=flatten(bang_2._0001), Data2=flatten(geo_6), Data3=flatten(geo_9), Data4=flatten(geo_10))
merge_10 = Merge(Data1=flatten("BLACK"), Data2=flatten(dup_2), Data3=flatten(dup_5), Data4=flatten(dup_6))
python_8 = PythonScript(polylines=merge_7, colors=merge_8, strokes=number_slider_5, render=toggle)  # -> out, a; inputs polylines: list of Polyline, colors: list, render: Boolean
# ---------- python_8: Python ----------
try:
    import Rhino
    import scriptcontext
    import System
    import rhinoscriptsyntax as rs
    GH=True
except:
    GH=False
    
bound = polylines[0]
origin_x = bound[0][0]
origin_y = bound[0][1]
width = abs( bound[0][0] - bound[2][0] )
height = abs( bound[0][1] - bound[2][1] )

fp = "C://Users//james//Documents//GitHub//blast-bot//APP//blastbot_app//data//"
file = "svgOut_L.svg"

'''This module is currently just a rough shot for sketching out ideas about svg
export.'''

def _s(o):
    if isinstance(o, str):
        if '_' in o:
            return o.replace('_','-')
        else: return o
    elif isinstance(o, System.Drawing.Color):
        return System.Drawing.ColorTranslator.ToHtml(att)
    else:
        return o

def xml_attributes(**kwargs):
    att_mask = '%s="%s"'
    return ' '.join([att_mask % (_s(k), kwargs[k]) for k in kwargs])

def to_svg(**kwargs):
    tag = kwargs.pop('tag')
    return '<%s %s />' % (tag, xml_attributes(**kwargs))

class svgRenderable(object):
    def render(self):
        if self.tag:
            return to_svg(**vars(self))
        else:
            print 'ERROR: no tag name'
            return

class svgPath(svgRenderable):
    def __init__(self, coords, color='#000', stroke='3px'):
        self.tag = 'path'
        self.fill = 'none'
        self.stroke = self.parse_color(color)
        #self.stroke_width = self.parse_stroke(stroke)
        self.stroke_width = self.parse_stroke(10)
        self.d = self.parse_coords(coords)
    def parse_coords(self, coords):
        coord_pairs = ['%s %s' % (c[0], c[1]) for c in coords]
        return 'M %s' % ' L '.join(coord_pairs)
    def parse_stroke(self, stroke):
        if isinstance(stroke, int) or isinstance(stroke, float):
            return '%spx' % stroke
        else: return stroke
    def parse_color(self, color):
        if isinstance(color, System.Drawing.Color):
            return System.Drawing.ColorTranslator.ToHtml(color)
        else: return color

def polylineToPath(polyline, color='#000', stroke='1px'):
    # get points from polyline
    pts = [pt for pt in polyline]
    # convert them to path coords
    coords = [(p.X-origin_x, origin_y-p.Y) for p in pts]
    path = svgPath(coords, color, stroke)
    return path.render()


def svg_wrap(*args):
    wrapper = '''<svg width="''' + str(width) + '''" height="''' + str(height) + '''" xmlns="http://www.w3.org/2000/svg" version="1.1">
%s
</svg>'''
    return wrapper % '\n'.join(args)


def test():
    c1 = to_svg(tag='circle', r='10', cx=50, cy=20,
             stroke='#FF0000', fill='#0A0A0A')
    c = svgCircle(30, 70, 15)
    return svg_wrap(c1,c.render())

if GH:
    if polylines and render:
        outlist = []
        for i, p in enumerate(polylines):
            if p:
                outlist.append(polylineToPath(p, colors[i]))
        a = svg_wrap(*outlist)
            
            


with open( fp + file, mode="w" ) as outfile:
    outfile.write(a)
# ---------- end python_8 ----------
python_9 = PythonScript(polylines=merge_9, colors=merge_10, strokes=number_slider_5, render=toggle)  # -> out, a; inputs polylines: list of Polyline, colors: list, render: Boolean
# ---------- python_9: Python ----------
try:
    import Rhino
    import scriptcontext
    import System
    import rhinoscriptsyntax as rs
    GH=True
except:
    GH=False
    
if polylines:
    bound = polylines[0]
    origin_x = bound[0][0]
    origin_y = bound[0][1]
    width = abs( bound[0][0] - bound[2][0] )
    height = abs( bound[0][1] - bound[2][1] )

fp = "C://Users//james//Documents//GitHub//blast-bot//APP//blastbot_app//data//"
file = "svgOut_R.svg"

'''This module is currently just a rough shot for sketching out ideas about svg
export.'''

def _s(o):
    if isinstance(o, str):
        if '_' in o:
            return o.replace('_','-')
        else: return o
    elif isinstance(o, System.Drawing.Color):
        return System.Drawing.ColorTranslator.ToHtml(att)
    else:
        return o

def xml_attributes(**kwargs):
    att_mask = '%s="%s"'
    return ' '.join([att_mask % (_s(k), kwargs[k]) for k in kwargs])

def to_svg(**kwargs):
    tag = kwargs.pop('tag')
    return '<%s %s />' % (tag, xml_attributes(**kwargs))

class svgRenderable(object):
    def render(self):
        if self.tag:
            return to_svg(**vars(self))
        else:
            print 'ERROR: no tag name'
            return

class svgPath(svgRenderable):
    def __init__(self, coords, color='#000', stroke='3px'):
        self.tag = 'path'
        self.fill = 'none'
        self.stroke = self.parse_color(color)
        #self.stroke_width = self.parse_stroke(stroke)
        self.stroke_width = self.parse_stroke(10)
        self.d = self.parse_coords(coords)
    def parse_coords(self, coords):
        coord_pairs = ['%s %s' % (c[0], c[1]) for c in coords]
        return 'M %s' % ' L '.join(coord_pairs)
    def parse_stroke(self, stroke):
        if isinstance(stroke, int) or isinstance(stroke, float):
            return '%spx' % stroke
        else: return stroke
    def parse_color(self, color):
        if isinstance(color, System.Drawing.Color):
            return System.Drawing.ColorTranslator.ToHtml(color)
        else: return color

def polylineToPath(polyline, color='#000', stroke='1px'):
    # get points from polyline
    pts = [pt for pt in polyline]
    # convert them to path coords
    coords = [(p.X-origin_x, origin_y-p.Y) for p in pts]
    path = svgPath(coords, color, stroke)
    return path.render()


def svg_wrap(*args):
    wrapper = '''<svg width="''' + str(width) + '''" height="''' + str(height) + '''" xmlns="http://www.w3.org/2000/svg" version="1.1">
%s
</svg>'''
    return wrapper % '\n'.join(args)


def test():
    c1 = to_svg(tag='circle', r='10', cx=50, cy=20,
             stroke='#FF0000', fill='#0A0A0A')
    c = svgCircle(30, 70, 15)
    return svg_wrap(c1,c.render())

if GH:
    if polylines and render:
        outlist = []
        for i, p in enumerate(polylines):
            if p:
                outlist.append(polylineToPath(p, colors[i]))
        a = svg_wrap(*outlist)
            
            


with open( fp + file, mode="w" ) as outfile:
    if a:
        outfile.write(a)
    else:
        outfile.write("<svg></svg>")
# ---------- end python_9 ----------

# ---- group: CALCULATE CLEANING TIME ESTIMATE
len_6 = Length(Curve=python_5.a)
ma_5 = MassAddition(Input=len_6)  # -> Result, PartialResults
division_12 = Division(A=ma_5.Result, B="300")
division_13 = Division(A=division_12, B="60")
mod_3 = Modulus(A=division_12, B="60")
round_5 = Round(Number=division_13)  # -> Nearest, Floor, Ceiling
round_6 = Round(Number=mod_3)  # -> Nearest, Floor, Ceiling
time_3 = ConstructTime(Hour=0, Minute=round_5.Floor, Second=round_6.Ceiling)

# ----
data_3 = Data(concat_2)
data_4 = Data(merge_6)
data_5 = Data(merge_5)
bang_3 = ExplodeTree(Data=time_3)  # -> _0000, _0001

# ---- group: PREPEND / APPEND POSITIONING CODE
init_positioning = Panel("""G0 X0 Y-50 F50.0
G05 P3000.0""")
final_positioning = Panel("""G00 Y-50 F200.0
M51
G04 P6000.0
G0 X0
G0 X0 Y0""")
init_positioning_2 = Panel("""G00 X1985 Y0 F300.0
G00 Y-50.0
G05 P3000.0""")
final_positioning_2 = Panel("""G00 Y-50 F200.0
M51
G04 P6000.0
G0 X0
G0 X0 Y0""")
merge_11 = Merge(Data2=flatten(init_positioning), Data3=flatten(python_6.GCODE), Data4=flatten(final_positioning))  # -> flatten(Result)
merge_12 = Merge(Data1=concat_2, Data2=flatten(init_positioning_2), Data3=flatten(python_7.GCODE), Data4=flatten(final_positioning_2))  # -> flatten(Result)

# ----
dispatch_2 = Dispatch(List=merge_11, DispatchPattern=null.NullFlags)  # -> ListA, ListB
dispatch_3 = Dispatch(List=merge_12, DispatchPattern=null_2.NullFlags)  # -> ListA, ListB

# ---- group: PREPEND / APPEND POSITIONING CODE (continued)
merge_13 = Merge(Data1=flatten(concat_2), Data2=flatten(dispatch_2.ListB))  # -> flatten(Result)
merge_14 = Merge(Data1=flatten(concat_2), Data2=flatten(dispatch_3.ListB))  # -> flatten(Result)

# ----
data_6 = Data(merge_13)
data_7 = Data(merge_14)

# ---- group: DATADAM - CLICK TO UPDATE OUTPUT FILES
dam = DataDam(DataA=data_3, DataB=data_6, DataC=data_7, DataD=data_4, DataE=data_5, BufferDelay=10000000, BufferMode=0)  # -> DataA, DataB, DataC, DataD, DataE

# ----
data_8 = Data(dam.DataA)
data_9 = Data(dam.DataB)
data_10 = Data(dam.DataC)
data_11 = Data(dam.DataD)
data_12 = Data(dam.DataE)
l_time_estimate = Panel(data_8)

left_gcode = Panel(data_9)
l_time_estimate_2 = Panel(time)

right_gcode = Panel(data_10)
r_time_estimate = Panel(time_2)

left_cleaning_gcode = Panel(data_11)
l_time_estimate_3 = Panel(bang_3._0000)

right_cleaning_gcode = Panel(data_12)
r_time_estimate_2 = Panel(bang_3._0001)

# ==== cluster DimStringers
scale = ClusterInput()
offset = ClusterInput()
x_bound = ClusterInput()
scale_2 = Number(scale)
offset_2 = Number(offset)
y_bound = ClusterInput()
x_bound_2 = Number(x_bound)
y_bound_2 = Number(y_bound)
pt = ConstructPoint(XCoordinate=offset_2, YCoordinate=0, ZCoordinate=0)
Y = UnitY(Factor=1)
pt_2 = ConstructPoint(XCoordinate=0, YCoordinate=offset_2, ZCoordinate=0)
X = UnitX(Factor=1)
line = LineSDL(Start=pt, Direction=Y, Length=1)
pt_3 = ConstructPoint(XCoordinate=0, YCoordinate=0, ZCoordinate=0)
pt_4 = ConstructPoint(XCoordinate=0, YCoordinate=y_bound_2, ZCoordinate=0)
line_2 = LineSDL(Start=pt_2, Direction=X, Length=1)
pt_5 = ConstructPoint(XCoordinate=x_bound_2, YCoordinate=0, ZCoordinate=0)
lineardim = LinearDimension(Line=line, PointA=pt_3, PointB=pt_4, Text="{0:0.00}", Size=scale_2)
lineardim_2 = LinearDimension(Line=line_2, PointA=pt_3, PointB=pt_5, Text="{0:0.00}", Size=scale_2)
