# Grasshopper definition 160523_rec_settings.gh (Grasshopper 0.9.76)
# plug-ins: Python Interpreter

board_label = Panel("B-18")
board_section = Panel("1")
panel = Panel("E:\TheLivingTemp\PSoAFacade\PrincetonDesignSoftware\03_Data")
concat = Concatenate(FragmentA=board_label, FragmentB="#", FragmentC=board_section)
python = PythonScript(active=Button(), board_id=concat, json_dir=panel)  # -> out, a
# ---------- python: Python ----------
import json
import os
import Grasshopper.Kernel.Special.GH_NumberSlider
#json_dir = r'E:\TheLivingTemp\PSoAFacade\PrincetonDesignSoftware\03_Data'
json_fileName = ( str(board_id) + "_settings.json" )
json_filePath = os.path.join(json_dir, json_fileName)

print json_filePath

settings_dict = {}

settings_dict["width"]= int(b_width)
settings_dict['length']= int(b_length)
settings_dict['start_offset']= st_offset 
settings_dict['end_offset']= end_offset     
settings_dict['scale']= scale 

#active = False
if active:

	with open(json_filePath, 'w') \
	as board_settings:
			json.dump(settings_dict, board_settings, indent=4, separators=(',', ': '), sort_keys=False )
		

print Grasshopper.Kernel.Special.GH_NumberSlider.TickCount
# ---------- end python ----------
