# Grasshopper definition 160601_PLtoGCODE.gh (Grasshopper 0.9.76)
# plug-ins: Python Interpreter

dom = ConstructDomain(DomainStart=Slider(2, range=0..100), DomainEnd=Slider(80, range=0..100))

number_slider = Slider(25, range=0..100)
range = Range(Domain=Domain(0, 1), Steps=number_slider)
range_2 = Range(Domain=dom, Steps=number_slider)
graph = GraphMapper(range, x0=0, x1=1, y0=0, y1=1, container_name="Power", Gx=0.6376811862, Gy=0.3695651889, power=2.212471431)
remap = RemapNumbers(Value=graph, Source=Domain(0, 1), Target=dom)  # -> Mapped, Clipped
ma = MassAddition(Input=range_2)  # -> Result, PartialResults
merge = Merge(Data1="0", Data2=ma.PartialResults)  # -> flatten(Result)
pt = Point("0,0,0")
X = UnitX(Factor=merge)
move = Move(Geometry=pt, Motion=X)  # -> Geometry, Transform
lng = ListLength(List=move.Geometry)
series = Series(Start=0, Step=1, Count=lng)
mod = Modulus(A=series, B="2")
larger = LargerThan(FirstNumber=mod, SecondNumber=0)  # -> LargerThan, OrEqualTo
Y = UnitY(Factor="280/2")
rev = Reverse(Vector=Y)
Y_2 = UnitY(Factor="280/2")
dispatch = Dispatch(List=graft(rev), DispatchPattern=graft(larger.LargerThan))  # -> ListA, ListB
dispatch_2 = Dispatch(List=graft(Y), DispatchPattern=graft(larger.LargerThan))  # -> ListA, ListB
merge_2 = Merge(Data1=dispatch_2.ListA, Data2=dispatch.ListB)
rev_2 = Reverse(Vector=merge_2)
move_2 = Move(Geometry=graft(move.Geometry), Motion=merge_2)  # -> Geometry, Transform
move_3 = Move(Geometry=graft(move.Geometry), Motion=rev_2)  # -> Geometry, Transform
merge_3 = Merge(Data1=move_2.Geometry, Data2=move_3.Geometry)  # -> flatten(Result)
pline = PolyLine(Vertices=merge_3, Closed=False)
move_4 = Move(Geometry=pline, Motion=Y_2)  # -> Geometry, Transform
crv = Curve(move_4.Geometry)

crv_2 = Curve(crv)
python = PythonScript(polyline=crv_2, feedRate="50.0")  # -> out, gcode; inputs polyline: Curve
# ---------- python: Python ----------
import rhinoscriptsyntax as rs

gcode = []

initPause = 3000.0
finalPause = 6000.0

pts = rs.CurvePoints(polyline)

for i, p in enumerate(pts):
    if i == 0:
        #move blaster to position
        gcode.append( "G00 X" + str(round(p.X,3)) + " F" + str(round(feedRate,3)) )
        gcode.append( "G00 Y" + str(round(p.Y,3)) + " F" + str(round(feedRate,3)) )
        #start blast stream
        gcode.append( "G05 P" + str(round(initPause,3)) )
    
    gcode.append( "G01 X" + str(round(p.X,3)) + " Y" + str(round(p.Y,3)) + " F" + str(round(feedRate,3)) )
    
    if i+1 == len(pts):
        #pause to let spray stream end
        gcode.append( "G04 P" + str(round(finalPause,3)) )
        #return to home position
        gcode.append( "G00 X0.0 F" + str(round(feedRate,3)) )
        gcode.append( "G00 Y0.0 F" + str(round(feedRate,3)) )
# ---------- end python ----------
panel = Panel(python.gcode)
