# Grasshopper definition 160609_blasting_generator.gh (Grasshopper 0.9.76)
# plug-ins: MeshEdit Components, Python Interpreter, HDTReference

update_svg = Button()
bool = Boolean(update_svg)
crv = Curve([<curve referenced from the Rhino model> x310])
cp = ControlPoints(Curve=crv)  # -> Points, Weights, Knots
item = ListItem(List=cp.Points, Index=Slider(3, range=0..10), Wrap=True)
pdecon = Deconstruct(Point=flatten(item))  # -> XComponent, YComponent, ZComponent
multiplication = Multiplication(A=pdecon.XComponent, B=1000)
subtraction = Subtraction(A=multiplication, B=pdecon.YComponent)
sort = SortList(Keys=subtraction, ValuesA=crv)  # -> Keys, ValuesA
panel = Panel("C:\Users\james\Desktop\Box Sync\THE_LIVING\1510_PSoA_SCAFFOLDING\03_WORK\160505_parse data\02_processed\")
board_width_mm = Panel("235")
python = PythonScript()  # -> path
# ---------- python: Python ----------
import sys
sys.path.append(path)

path = ghenv.LocalScope.ghdoc.Path
path = path.split("\\")
path = "\\".join(path[:-1]) + "\\"
# ---------- end python ----------
panel_2 = Panel(python)
merge = Merge(Data1=python, Data2="south_cut_lengths.json")
join = TextJoin(Text=merge)
file = ReadFile(File=join, PerLineParse=False)
blast_spacing_mm = Slider(10, range=5..20)
blast_spacing = Number(blast_spacing_mm)
multiplication_2 = Multiplication(A=blast_spacing, B="2")

# ---- group: DIRECITONAL WEIGHTING
number_slider = Slider(2, range=0.5..2)
number_slider_2 = Slider(1, range=0..1)
number_slider_3 = Slider(2000, range=0..10000)

# ----
number_slider_4 = Slider(1, range=1..1.25)
number_slider_5 = Slider(300, range=100..300)
number_slider_6 = Slider(7.5, range=1..20)
path = FilePath(python)
bool_2 = Boolean(bool)

# ----
# 1. SET BOARD SLOT ID
# 2. CONFIRM BOARD
# 3. ADJUST START CUT POSITION
# 4. ADJUST X-AXIS SCALING
# 5. PRESS BUTTON TO GENERATE
# PATH GEOMETRY
# 6. PRESS BUTTON TO GENERATE
# GCODE AND EXPORT
# 7. UPDATED TIME ESTIMATE
# (ONLY UPDATES AFTER GENERATION)
slot_id = Slider(208, range=0..309)
start_offset_mm = Slider(0, range=-150..150)
generate_paths = Button()
output_files = Button()
list = ValueList({"(1x) 5.0mm/s": 5.0, "(1.5x) 7.5mm/s": 7.5, "(2x) 10mm/s": 10.0, "(5x) 25mm/s": 25.0, "(10x) 50mm/s": 50.0}, selected="(1.5x) 7.5mm/s")
x_scale = Slider(0.98, range=0.5..1.25)
bool_3 = Boolean(generate_paths)
bool_4 = Boolean(output_files)

num = Number(list)
int = Integer(slot_id)
txt = Text(int)
int_2 = Integer(slot_id)
split = SplitList(List=sort.ValuesA, Index=int_2)  # -> ListA, ListB
split_2 = SplitList(List=split.ListB, Index="1")  # -> ListA, ListB
mesh = Mesh(split.ListA)
mesh_2 = Mesh(split_2.ListA)
previewlw = CustomPreviewLineweights(Geometry=split_2.ListB, Shader="GRAY", Thickness=Slider(1, range=0..10))
previewlw_2 = CustomPreviewLineweights(Geometry=split.ListA, Shader="BLACK", Thickness=Slider(2, range=0..10))
preview = CustomPreview(Geometry=mesh, Shader="BLACK")
start_offset = Number(start_offset_mm)
num_2 = Number(x_scale)
previewlw_3 = CustomPreviewLineweights(Geometry=split_2.ListA, Shader="RED", Thickness=Slider(1, range=0..10))
preview_2 = CustomPreview(Geometry=mesh_2, Shader="RED")
bool_5 = Boolean(bool_3)
num_3 = Number(start_offset)
num_4 = Number(num_2)
num_5 = Number(num)
bool_6 = Boolean(bool_4)
dam = DataDam(DataA=bool_6, BufferDelay=5000000, BufferMode=2)
start_offset_2 = Number(start_offset)
num_6 = Number(num_2)
bool_7 = Boolean(bool_4)
int_3 = Integer(slot_id)
dam_2 = DataDam(DataA=dam, BufferDelay=2500000, BufferMode=2)

# ---- group: SAVE SETTINGS TO EXTERNAL FILE
path_2 = FilePath(python)
python_2 = PythonScript(fp=path_2, file="south_layout.json")  # -> out, slotID, board, segment
# ---------- python_2: Python ----------
import json

slotID = []
board = []
segment = []

with open( fp + file, mode="r" ) as infile:
    data = json.load(infile)
    
    for key in data.keys():
        slotID.append( key )
        
        hashIDX = data[key].find("#")
        
        board.append( data[key][:hashIDX] )
        segment.append( data[key][hashIDX+1:] )
# ---------- end python_2 ----------
lng = ListLength(List=python_2.slotID)

# ----
keysearch = KeyValueSearch(Keys=python_2.slotID, Values=python_2.segment, Search=txt)
keysearch_2 = KeyValueSearch(Keys=python_2.slotID, Values=python_2.board, Search=txt)

# ---- group: SAVE SETTINGS TO EXTERNAL FILE (continued)
python_3 = PythonScript(fp=path_2, slots=lng, slotID=txt, board=keysearch_2, section=keysearch, start_offset=start_offset_mm, x_scale=x_scale)  # -> out, settings; inputs slots: Int32, slotID: Int32, section: Int32, start_offset: Int32; disabled
# ---------- python_3: Python ----------
file = "board_settings.txt"

header = "slotID,board,start_offset,x_scale \n"
data = [ "%i \n" %(i-1) for i in range(slots+1) ]

settings = "%i,%s #%i,%i,%f \n" %(slotID,board,section,start_offset,x_scale)

with open( fp + file, mode="r" ) as f:
    for i, line in enumerate(f.readlines() ):
        data[i] = line
f.close()
data[0] = header
data[slotID+1] = settings

with open( fp + file, mode="w" ) as f:
    for entry in data:
        f.write(entry)
        
f.close()
# ---------- end python_3 ----------

# ----
board_label = Panel(keysearch_2)
board_section = Panel(keysearch)

merge_2 = Merge(Data1=flatten(panel), Data2=flatten(keysearch_2), Data3=flatten("_dilated_24.png"))
merge_3 = Merge(Data1=flatten(panel), Data2=flatten(keysearch_2), Data3=flatten("_resized.png"))

# ---- group: blob path
join_2 = TextJoin(Text=merge_2)

# ---- group: rgb path
join_3 = TextJoin(Text=merge_3)

# ----
concat = Concatenate(FragmentA=keysearch_2, FragmentB=keysearch, JoinSeparator=" #")

texttoscreen = RenderTextToScreen(Text=concat, Location="60,40,0", Size="36", Color=RGB(0, 0, 0), Font="Roboto Slab Bold", m_scWithvp=False)

subtraction_2 = Subtraction(A=keysearch, B=1)
img = ImportImage(File=join_2)

# ---- group: mesh resolution dropdown
bbox = BoundingBox(Content=img, Plane=PlaneXY(0, 0, 0))  # -> Box, Box_2
debox = DeconstructBox(Box=bbox.Box_2)  # -> Plane, X, Y, Z
number_slider_7 = Slider(1, range=1..5)
dedomain = DeconstructDomain(Domain=debox.X)  # -> Start, End
dedomain_2 = DeconstructDomain(Domain=debox.Y)  # -> Start, End
division = Division(A=dedomain.End, B=number_slider_7)
division_2 = Division(A=dedomain_2.End, B=number_slider_7)
img_2 = ImportImage(File=join_3, XSamples=division, YSamples=division_2)

# ---- group: VISUALIZE CUT LOCATIONS
ft_mm = Panel("304.8")
python_4 = PythonScript(data=file, boardID=keysearch_2)  # -> out, a
# ---------- python_4: Python ----------
import json

a = []

d = json.loads(data)

lengths = d[boardID]

sum = 0

for l in lengths:
    sum += l
    a.append(sum)
# ---------- end python_4 ----------
Y = UnitY(Factor=1)
pt = ConstructPoint(XCoordinate=0, YCoordinate=0, ZCoordinate=0)
multiplication_3 = Multiplication(A=python_4.a, B=ft_mm)
line = LineSDL(Start=pt, Direction=Y, Length=board_width_mm)
X = UnitX(Factor=multiplication_3)
move = Move(Geometry=line, Motion=X)  # -> Geometry, Transform
previewlw_4 = CustomPreviewLineweights(Geometry=move.Geometry, Shader=ColourSwatch(SwatchColor=RGB(0, 0, 0)), Thickness=Slider(2, range=0..10))

# ----
division_3 = Division(A=board_width_mm, B=dedomain_2.End)

# ---- group: blob mesh
scale = Scale(Geometry=img, Center=Point(0, 0, 0), Factor=division_3)  # -> Geometry, Transform

# ----
addition = Addition(A=subtraction_2, B=1)

merge_4 = Merge(Data1=flatten("0"), Data2=flatten(multiplication_3))
item_2 = ListItem(List=merge_4, Index=subtraction_2, Wrap=True)
item_3 = ListItem(List=merge_4, Index=addition, Wrap=True)
pt_2 = ConstructPoint(XCoordinate=item_2, YCoordinate=0, ZCoordinate=0)
pt_3 = ConstructPoint(XCoordinate=item_3, YCoordinate=0, ZCoordinate=0)
xy = XYPlane(Origin=pt_2)
dist = Distance(PointA=pt_2, PointB=pt_3)
num_7 = Number(dist)

# ----
# 3. CONFIRM BOARD LENGTH
num_8 = Number(num_7)
int_4 = Integer(num_8)
board_leng = Panel(int_4)

# ---- group: rgb mesh
scale_2 = Scale(Geometry=img_2, Center=Point(0, 0, 0), Factor=division_3)  # -> Geometry, Transform

# ----
num_9 = Number(start_offset)
X_2 = UnitX(Factor=num_9)
move_2 = Move(Geometry=scale_2.Geometry, Motion=X_2)  # -> Geometry, Transform
num_10 = Number(num_2)
scale_nu = ScaleNU(Geometry=move_2.Geometry, Plane=xy, ScaleX=num_10, ScaleY=1, ScaleZ=1)  # -> Geometry, Transform
mesh_3 = Mesh(scale_nu.Geometry)

transform = Transform(Geometry=scale.Geometry, Transform=move_2.Transform)
transform_2 = Transform(Geometry=transform, Transform=scale_nu.Transform)
bbox_2 = BoundingBox(Content=transform_2, Plane=PlaneXY(0, 0, 0))  # -> Box, Box_2
final_mesh = Mesh(transform_2)
debox_2 = DeconstructBox(Box=bbox_2.Box_2)  # -> Plane, X, Y, Z
dedomain_3 = DeconstructDomain(Domain=debox_2.Y)  # -> Start, End
dedomain_4 = DeconstructDomain(Domain=debox_2.X)  # -> Start, End
python_5 = PythonScript(Update=bool_5, DataIn=concat)  # -> DataOut; inputs Update: Boolean, DataIn: tree
# ---------- python_5: Python ----------
# Make persistent variable
if "foo" not in globals():
    foo = 0

# Update variable
if Update:
    foo = DataIn

# Output variable
DataOut = foo
# ---------- end python_5 ----------
python_6 = PythonScript(Update=bool_5, DataIn=final_mesh)  # -> DataOut; inputs Update: Boolean, DataIn: tree; same code as python_5
division_4 = Division(A=dedomain_4.End, B=blast_spacing_mm)
division_5 = Division(A=dedomain_3.End, B=blast_spacing_mm)
recgrid = Rectangular(Plane=PlaneXY(0, 0, 0), SizeX=blast_spacing_mm, SizeY=blast_spacing_mm, ExtentX=division_4, ExtentY=division_5)  # -> Cells, flatten(Points)
final_mesh_2 = Mesh(python_6)
sample_points = Point(recgrid.Points)
demesh = DeconstructMesh(Mesh=final_mesh_2)  # -> Vertices, Faces, Colours, Normals
meshcp = MeshClosestPoint(Point=sample_points, Mesh=final_mesh_2)  # -> Point, Index, Parameter
deface = DeconstructFace(Face=demesh.Faces)  # -> CornerA, CornerB, CornerC, CornerD
item_4 = ListItem(List=deface.CornerA, Index=meshcp.Index, Wrap=True)
item_5 = ListItem(List=demesh.Colours, Index=item_4, Wrap=True)
argb = SplitARGB(Colour=item_5)  # -> Alpha, Red, Green, Blue
larger = LargerThan(FirstNumber=argb.Red, SecondNumber="0")  # -> LargerThan, OrEqualTo

# ---- group: all points
pt_4 = Point(sample_points)

# ----
dispatch = Dispatch(List=pt_4, DispatchPattern=larger.LargerThan)  # -> ListA, ListB

# ---- group: cut values
num_11 = Number(multiplication_3)

# ---- group: knot points
pt_5 = Point(dispatch.ListA)

# ---- group: board section
num_12 = Number(subtraction_2)

# ----
merge_5 = Merge(Data1=flatten("0"), Data2=flatten(num_11))
python_7 = PythonScript(points=pt_5, cuts=merge_5, section=num_12, startShift=num_3, endShift=num_4)  # -> out, startCut, endCut, split_pts; inputs points: list, cuts: list
# ---------- python_7: Python ----------
import rhinoscriptsyntax as rs

split_pts = []

startCut = cuts[int(section)]
endCut = cuts[int(section)+1]

for pt in points:
    p = rs.coerce3dpoint(pt)
    
    if p.X > startCut and p.X < endCut:
        split_pts.append(p)
        continue
# ---------- end python_7 ----------
pt_6 = ConstructPoint(XCoordinate=python_7.startCut, YCoordinate=0, ZCoordinate=0)
pt_7 = ConstructPoint(XCoordinate=python_7.endCut, YCoordinate=0, ZCoordinate=0)
pt_8 = Point(pt_6)
pt_9 = Point(pt_7)

# ---- group: ISOLATE BLAST AREA BOUNDARY
pt_10 = Point(python_7.split_pts)
del = DelaunayMesh(Points=pt_10, Plane=PlaneXY(0, 0, 0))
faceb = FaceBoundaries(Mesh=del)
len = Length(Curve=faceb)
larger_2 = LargerThan(FirstNumber=len, SecondNumber="45")  # -> LargerThan, OrEqualTo
cullf = CullFaces(Mesh=del, Pattern=larger_2.LargerThan)
disjoint = DisjointMesh(Mesh=cullf)
nakededge = MeshNakedEdge(Mesh=disjoint)  # -> V, A, B
item_6 = ListItem(List=nakededge.V, Index=nakededge.A, Wrap=True)
item_7 = ListItem(List=nakededge.V, Index=nakededge.B, Wrap=True)
ln = Line(StartPoint=item_6, EndPoint=item_7)
join_4 = JoinCurves(Curves=ln, Preserve=False)  # -> flatten(Curves)

# ---- group: VISUALIZE CUT LOCATION
Y_2 = UnitY(Factor=1)
line_2 = LineSDL(Start=[pt_8, pt_9], Direction=Y_2, Length=board_width_mm)
previewlw_5 = CustomPreviewLineweights(Geometry=line_2, Shader=ColourSwatch(SwatchColor=RGB(255, 0, 0)), Thickness=Slider(4, range=0..10))

# ---- group: VISUALIZE KNOT BOUNDARY
panel_3 = Panel("""0.1
3""")
swatch = ColourSwatch(SwatchColor=RGB(255, 255, 31))
dash = DashPattern(Curve=join_4, Pattern=panel_3)  # -> Dashes, Gaps
previewlw_6 = CustomPreviewLineweights(Geometry=dash.Dashes, Shader=swatch, Thickness=Slider(4, range=0..10))

# ----
cleaning_zone_overlap = Panel("100")
max_blast_width = Panel("1985")
flex_zone = Panel("600")
pt_11 = Point(pt_8)
pt_12 = Point(pt_9)
python_8 = PythonScript(
    startPt=pt_11,
    endPt=pt_12,
    blob=join_4,
    height=board_width_mm,
    width=max_blast_width,
    flex=flex_zone,
    overlap=cleaning_zone_overlap)  # -> out, zones, blob_1, blastPt_1, blob_2, blastPt_2; inputs startPt: Point3d, endPt: Point3d, blob: list of Curve
# ---------- python_8: Python ----------
import rhinoscriptsyntax as rs
import math

blastPt_1 = []
blob_1 = []
blastPt_2 = []
blob_2 = []
zones = []
a=[]

l_max = 0
r_min = 10000.0

#function to fill blob with point grid
def fillBlob( crv ):
    #output points
    outPts = []
    #extract control points of boundary curve
    cP = rs.CurvePoints(crv)
    x_step = 1000.0
    y_step = 1000.0
    x_min = 10000.0
    x_max = 0
    y_min = 100000.0
    y_max = 0
    for i, pt in enumerate(cP):
        x_min = min(pt.X, x_min)
        x_max = max(pt.X, x_max)
        y_min = min(pt.Y, y_min)
        y_max = max(pt.Y, y_max)
        if i > 0:
            if abs(pt.X - cP[i-1].X) > 0:
                x_step = min( x_step, abs(pt.X - cP[i-1].X))
            if abs(pt.Y - cP[i-1].Y) > 0:
                y_step = min( y_step, abs(pt.Y - cP[i-1].Y))

    
    for y in range( int((y_max-y_min)/y_step ) + 1):
        for x in range( int((x_max-x_min)/x_step) + 1):
            #print "Point @ (" + str(x) + ", " + str(y) + ")"
            newPt = rs.AddPoint((x_min + x_step*x,y_min + y_step*y,0))
            a.append(newPt)
            if rs.PointInPlanarClosedCurve( newPt, crv ):
                outPts.append(newPt)
    
    return outPts

#demarcate blast sections
if endPt.X - startPt.X < width:
    zones.append( rs.AddPolyline([startPt, (startPt.X + width,0,0), (startPt.X + width,height,0), (startPt.X, height,0), startPt]))
else:
    zones.append( rs.AddPolyline([startPt, (width,0,0), (width,height,0), (0, height,0), startPt]))
    zones.append( rs.AddPolyline([endPt, (endPt.X-width,0,0), (endPt.X-width, height,0), (endPt.X, height, 0), endPt]))

for crv in blob:
    #check if centroid is within L half
    centroid = rs.CurveAreaCentroid(crv)[0]
    cP = rs.CurvePoints(crv)
    max_x = max([pt[0] for pt in cP])
    min_x = min([pt[0] for pt in cP])
    
    #check if board board is too long for single pass
    if endPt.X - startPt.X < width:
        blob_1.append( crv )
        blastPt_1.extend( fillBlob(crv) )
        l_max = max( l_max, max_x )
        continue
    
    
    #check if blob is closer to left
    if max_x < startPt.X + width-100:
        #check if in L "safe" zone
        if max_x < (startPt.X + width - flex):
            blob_1.append( crv )
            blastPt_1.extend( fillBlob(crv) )
            l_max = max( l_max, max_x )
            continue
        #not in safe zone
        else:
            #check if blob is completely within L flex zone
            if max_x < startPt.X + width-100:
                blob_1.append( crv )
                blastPt_1.extend( fillBlob(crv) )
                l_max = max( l_max, max_x )
                continue
    
    #check if blob is closer to right
    elif min_x > endPt.X - width:
        #check if in R "safe" zone
        if min_x > endPt.X - width - flex:
            blob_2.append(crv)
            blastPt_2.extend( fillBlob(crv) )
            r_min = min( r_min, min_x )
            continue
        #check if completely within R flex zone
        if min_x > endPt.X - width:
            blob_2.append(crv)
            blastPt_2.extend( fillBlob(crv) )
            r_min = min( r_min, min_x )
            continue
    #blob straddles boundary and must be split
    else:
        l_half = rs.CurveBooleanIntersection(zones[0],crv)
        r_half = rs.CurveBooleanIntersection(zones[1],crv)
        
        blob_1.append( l_half )
        blastPt_1.extend( fillBlob(l_half) )
        blob_2.append( r_half )
        blastPt_2.extend( fillBlob(r_half) )

if len(zones) > 1:
    if len(blastPt_2) < 1:
        l_max = width
        r_min = l_max
    split_x = (r_min - l_max)/2.0 + l_max
else:
    split_x = endPt.X

#shift ends of zones to split
#shift zone 0 points left
z_pt = rs.CurvePoints( zones[0] )

z_pt[1].X = min(split_x + overlap, startPt.X + width-100)
z_pt[2].X = min(split_x + overlap, startPt.X + width-100)

zones[0] = rs.AddPolyline( z_pt )
if len(zones) > 1:
    z1_pt = rs.CurvePoints( zones[0] )
    #shift zone 1 points right
    z_pt = rs.CurvePoints( zones[1] )
    z_pt[1].X = z1_pt[1].X - overlap
    z_pt[2].X = z1_pt[2].X - overlap
    
    zones[1] = rs.AddPolyline( z_pt )
# ---------- end python_8 ----------

data = Data(concat)

toggle = BooleanToggle(False)
python_9 = PythonScript(
    points=python_8.blastPt_1,
    startPoint=pt_11,
    startX="0",
    err=multiplication_2,
    xWeight=number_slider,
    diagMove=toggle,
    blastSpeed=num_5,
    moveSpeed=number_slider_5,
    y_scale=number_slider_4)  # -> out, GCODE, lines_00, lines_01; inputs points: list of Point3d, startPoint: Point3d, diagMove: Boolean
# ---------- python_9: Python ----------
import rhinoscriptsyntax as rs
import scriptcontext as sc
import Rhino
import random
import math

sc.doc = ghdoc

moveRef = rs.coerce3dpoint(startPoint)

def gen_GCODE(pt, code):
    if code == 1:
        feed = blastSpeed
        return ["G01" + " X" + str(round(startX + pt[0] - moveRef.X, 3)) + " Y" + str(round(pt[1]*y_scale, 3)) + " F" + str(feed)]
    else:
        feed = moveSpeed
        if diagMove:
            return ["G01" + " X" + str(round(startX + pt[0] - moveRef.X, 3)) + " Y" + str(round(pt[1]*y_scale, 3)) + " F" + str(feed)]
        else:
            line1 = "G01" + " X" + str(round(startX + pt[0] - moveRef.X, 3)) + " F" + str(feed)
            line2 = "G01" + " Y" + str(round(pt[1]*y_scale, 3)) + " F" + str(feed)
            return [line1, line2]

def linearDistance(p1, p2):
    return math.sqrt((p2[0]-p1[0])**2 + xWeight * (p2[1]-p1[1])**2)

#err = 15.00
endPoints = []
lines_00 = []
lines_01 = []
GCODE = []

for point in points:
    pt = rs.coerce3dpoint(point)
    endPoints.append([pt.X, pt.Y])

if startPoint is None:
    curr_Point = endPoints.pop(random.choice(range(len(endPoints))))
    GCODE.extend( gen_GCODE(curr_Point, 0) )
else:
    sp = rs.coerce3dpoint(startPoint)
    curr_Point = [sp.X, sp.Y]

for i in range(len(endPoints)):
    closest = 0
#    dir = 0
    minDist = float("inf")
    
    for j in range(len(endPoints)):
        pt = endPoints[j]
        dist = linearDistance(curr_Point, pt)
        if dist < minDist:
            closest = j
#            dir = k
            minDist = dist
    
    next_Point = endPoints.pop(closest)
    
    if minDist > err:
        GCODE.extend( gen_GCODE(next_Point, 0) )
        if diagMove:
            lines_00.append(rs.AddLine(rs.AddPoint(curr_Point[0], curr_Point[1], 0), rs.AddPoint(next_Point[0], next_Point[1], 0)))
        else:
            if curr_Point[0] - next_Point[0] != 0:
                lines_00.append(rs.AddLine((curr_Point[0], curr_Point[1], 0), (next_Point[0], curr_Point[1], 0) ) )
            if curr_Point[1] - next_Point[1] != 0:
                lines_00.append( rs.AddLine( (next_Point[0], curr_Point[1],0), (next_Point[0], next_Point[1], 0) ) )
    
    else:
        GCODE.extend( gen_GCODE(next_Point, 1) )
        lines_01.append(rs.AddLine(rs.AddPoint(curr_Point[0], curr_Point[1], 0), rs.AddPoint(next_Point[0], next_Point[1], 0)))
    
    curr_Point = next_Point
    
#print GCODE

#trigger = True
# ---------- end python_9 ----------
python_10 = PythonScript(
    points=python_8.blastPt_2,
    startPoint=pt_12,
    startX=max_blast_width,
    err=multiplication_2,
    xWeight=number_slider,
    diagMove=toggle,
    blastSpeed=num_5,
    moveSpeed=number_slider_5,
    y_scale=number_slider_4)  # -> out, GCODE, lines_00, lines_01; inputs points: list of Point3d, startPoint: Point3d, diagMove: Boolean; same code as python_9

python_11 = PythonScript(
    zones=python_8.zones,
    machineWidth=max_blast_width,
    spacing="20.0",
    cleanSpeed="300.0",
    cleanWait=Toggle(False),
    endTurns=Toggle(False),
    extraLines=Slider(0, range=0..3),
    y_scale=number_slider_4)  # -> out, a, GCODE; inputs zones: Curve, extraLines: Int32
# ---------- python_11: Python ----------
import rhinoscriptsyntax as rs
import math

cP = rs.CurvePoints( zones )
a = []
GCODE = []

def genGCODE( code, inputs ):
    line = "G0" + str(code)
    if code == 2 or code == 3:
        line += " I" + str(round(inputs[0]-x_offset,3)) + " J" + str(round(inputs[1]*y_scale,3))
        line += " X" + str(round(inputs[2]-x_offset,3)) + " Y" + str(round(max(inputs[3]*y_scale,-100),3))
        line += " F" + str(round(inputs[4],3))
    elif code == 0 or code == 1:
        line += " X" + str(round(inputs[0]-x_offset,3)) + " Y" + str(round(max(inputs[1]*y_scale,-100),3))
        line += " F" + str(round(inputs[2],3))
    elif code == 4 or code == 5:
        line += " P" + str(round(inputs[0],3))
    else:
        return
    GCODE.append(line)

#determine start and initial direction from L or R sections
startX = cP[0].X

#left side
if cP[0].X < cP[1].X:
    dir = 1.0
    x_offset = startX

#right side
else:
    dir = -1.0
    x_offset = startX - machineWidth
    #print x_offset

#connecting arc radius
r = spacing*0.5

#zone dimensions
width = abs(cP[0].X - cP[1].X) - spacing
if endTurns:
    width -= spacing
height = abs(cP[1].Y - cP[2].Y)

#calculate number of passes at spacing and start offset
passes = int(math.ceil(height/spacing))
startH = ((passes*spacing) - height)/-2

def genArc( firstPt, secondPt, radius, direction ):
    arcCenter = ( firstPt[0], (secondPt[1] - firstPt[1])/2.0 + firstPt[1], 0)
    arcDir = (arcCenter[0] + direction, arcCenter[1], 0)
    arcPlane = rs.PlaneFromPoints(arcCenter, firstPt, arcDir)
    #gen gcode
    if direction > 0:
        genGCODE(2,[arcCenter[0],arcCenter[1],secondPt[0],secondPt[1], cleanSpeed])
    else:
        genGCODE(3,[arcCenter[0],arcCenter[1],secondPt[0],secondPt[1], cleanSpeed])
    return rs.AddArc(arcPlane, radius, -180 * abs(dir)) 

#generate starting point
startPt = [startX, startH - spacing, 0]
if endTurns:
    startPt[0] += dir*r


#gen GCODE to move to start position
GCODE.append("G00 Y-100")
genGCODE( 0, [startPt[0],-100, cleanSpeed])
#gcode to start blast stream
if cleanWait:
    genGCODE( 5, [8000.0] )
else:
    genGCODE(5, [2500.0] )
genGCODE( 1, [startPt[0],startPt[1], cleanSpeed])


endPt = (startPt[0], startH, 0)
if endTurns:
    a.append( genArc( startPt, endPt, r, dir ) )
else:
    genGCODE(1,[endPt[0],endPt[1],cleanSpeed])
    a.append( rs.AddLine(startPt, endPt) )

for i in range( passes + 1 + extraLines ):
    flip = 1 - 2*(i%2)
    start = [startX + dir*(width)*(i%2), startH + spacing*(i),0]
    
    if endTurns:
        start[0] += dir*r*flip
        start[0] += dir*spacing*(i%2)
    
    end = (start[0] + dir*flip*width, start[1], 0)
    
    a.append( rs.AddLine(start,end) )
    genGCODE(1,[end[0],end[1],cleanSpeed])
    
    nextPt = (end[0],end[1]+spacing,0)
    if endTurns:
        a.append( genArc( end, nextPt, r, -dir*flip ) )
    else:
        genGCODE(1, [nextPt[0],nextPt[1],cleanSpeed])
        a.append( rs.AddLine(end, nextPt) )

if nextPt[1] < height+50:
    genGCODE(0,[nextPt[0],height+50,cleanSpeed])

genGCODE(4,[6000.0])
GCODE.append( "G00 X0" )
GCODE.append( "G00 Y0" )
# ---------- end python_11 ----------

panel_4 = Panel(python_11.GCODE)
concat_2 = Concatenate(FragmentA="$$ ", FragmentB=data)

# ---- group: VISUALIZE CLEANING PATH
panel_5 = Panel("""2
6""")
dash_2 = DashPattern(Curve=python_11.a, Pattern=panel_5)  # -> Dashes, Gaps
previewlw_7 = CustomPreviewLineweights(Geometry=dash_2.Dashes, Shader=ColourSwatch(SwatchColor=RGB(0, 0, 31)), Thickness=Slider(2.5, range=0..10))

# ---- group: VISUALIZE PATH
swatch_2 = ColourSwatch(SwatchColor=RGB(0, 149, 255))
swatch_3 = ColourSwatch(SwatchColor=RGB(255, 0, 0))
geo = Geometry(python_9.lines_01)
geo_2 = Geometry(python_9.lines_00)
geo_3 = Geometry(python_10.lines_00)
geo_4 = Geometry(python_10.lines_01)
preview_3 = CustomPreview(Geometry=geo_2, Shader=swatch_2)
previewlw_8 = CustomPreviewLineweights(Geometry=geo, Shader=swatch_3, Thickness=Slider(3, range=0..10))
preview_4 = CustomPreview(Geometry=geo_3, Shader=ColourSwatch(SwatchColor=RGB(0, 149, 255)))
previewlw_9 = CustomPreviewLineweights(Geometry=geo_4, Shader=ColourSwatch(SwatchColor=RGB(255, 0, 0)), Thickness=Slider(3, range=0..10))

# ----
null = NullItem(Item=python_9.GCODE)  # -> NullFlags, InvalidFlags, Description
null_2 = NullItem(Item=python_10.GCODE)  # -> NullFlags, InvalidFlags, Description
bang = ExplodeTree(Data=graft(python_8.zones))  # -> _0000, Branch1

# ---- group: ADD LABEL HEADER
bang_2 = ExplodeTree(Data=python_11.GCODE)  # -> _0000, Branch1
data_2 = Data(data)
concat_3 = Concatenate(FragmentA="$$ ", FragmentB=data_2)
merge_6 = Merge(Data1=flatten(concat_3), Data2=flatten("$$ R CLEAN $$"), Data3=flatten(bang_2.Branch1))  # -> flatten(Result)
merge_7 = Merge(Data1=flatten(concat_3), Data2=flatten("$$ L CLEAN $$"), Data3=flatten(bang_2._0000))  # -> flatten(Result)

# ---- group: OUTPUT SVG FOR VISUALIZATION
int_5 = Integer("5")
int_6 = Integer("2")
col = Colour(swatch_2)
geo_5 = Geometry(geo_4)
col_2 = Colour(swatch_3)
int_7 = Integer("5")
int_8 = Integer("2")
geo_6 = Geometry(python_8.blob_1)
col_3 = Colour(swatch)
int_9 = Integer("1")
geo_7 = Geometry(geo_2)
col_4 = Colour(swatch_2)
geo_8 = Geometry(geo)
col_5 = Colour(swatch_3)
geo_9 = Geometry(python_8.blob_2)
col_6 = Colour(swatch)
int_10 = Integer("1")
geo_10 = Geometry(geo_3)
int_11 = Integer("2")
lng_2 = ListLength(List=geo_6)
lng_3 = ListLength(List=geo_7)
lng_4 = ListLength(List=geo_8)
lng_5 = ListLength(List=geo_9)
lng_6 = ListLength(List=geo_10)
lng_7 = ListLength(List=geo_5)
dup = DuplicateData(Data=int_5, Number=lng_4, Order=True)
dup_2 = DuplicateData(Data=col_3, Number=lng_2, Order=True)
dup_3 = DuplicateData(Data=int_9, Number=lng_2, Order=True)
dup_4 = DuplicateData(Data=col_4, Number=lng_3, Order=True)
dup_5 = DuplicateData(Data=int_6, Number=lng_3, Order=True)
dup_6 = DuplicateData(Data=col_5, Number=lng_4, Order=True)
dup_7 = DuplicateData(Data=col_6, Number=lng_5, Order=True)
dup_8 = DuplicateData(Data=int_10, Number=lng_5, Order=True)
dup_9 = DuplicateData(Data=col, Number=lng_6, Order=True)
dup_10 = DuplicateData(Data=int_11, Number=lng_6, Order=True)
dup_11 = DuplicateData(Data=col_2, Number=lng_7, Order=True)
dup_12 = DuplicateData(Data=int_7, Number=lng_7, Order=True)
merge_8 = Merge(Data1=flatten(bang._0000), Data2=flatten(geo_6), Data3=flatten(geo_7), Data4=flatten(geo_8))
merge_9 = Merge(Data1=flatten("BLACK"), Data2=flatten(dup_2), Data3=flatten(dup_4), Data4=flatten(dup_6))
merge_10 = Merge(Data1=flatten(int_8), Data2=flatten(dup_3), Data3=flatten(dup_5), Data4=flatten(dup))
merge_11 = Merge(Data1=flatten(bang.Branch1), Data2=flatten(geo_9), Data3=flatten(geo_10), Data4=flatten(geo_5))
merge_12 = Merge(Data1=flatten("BLACK"), Data2=flatten(dup_7), Data3=flatten(dup_9), Data4=flatten(dup_11))
merge_13 = Merge(Data1=flatten(int_8), Data2=flatten(dup_8), Data3=flatten(dup_10), Data4=flatten(dup_12))
python_12 = PythonScript(polylines=merge_8, colors=merge_9, strokes=merge_10, render=bool_2)  # -> out, a; inputs polylines: list of Polyline, colors: list, strokes: list of Int32, render: Boolean
# ---------- python_12: Python ----------
try:
    import Rhino
    import scriptcontext
    import System
    import rhinoscriptsyntax as rs
    GH=True
except:
    GH=False
    
bound = polylines[0]
origin_x = bound[0][0]
origin_y = bound[0][1]
width = abs( bound[0][0] - bound[2][0] )
height = abs( bound[0][1] - bound[2][1] )

fp = "C://Users//james//Documents//GitHub//blast-bot//APP//blastbot_app//data//"
file = "svgOut_L.svg"

'''This module is currently just a rough shot for sketching out ideas about svg
export.'''

def _s(o):
    if isinstance(o, str):
        if '_' in o:
            return o.replace('_','-')
        else: return o
    elif isinstance(o, System.Drawing.Color):
        return System.Drawing.ColorTranslator.ToHtml(att)
    else:
        return o

def xml_attributes(**kwargs):
    att_mask = '%s="%s"'
    return ' '.join([att_mask % (_s(k), kwargs[k]) for k in kwargs])

def to_svg(**kwargs):
    tag = kwargs.pop('tag')
    return '<%s %s />' % (tag, xml_attributes(**kwargs))

class svgRenderable(object):
    def render(self):
        if self.tag:
            return to_svg(**vars(self))
        else:
            print 'ERROR: no tag name'
            return

class svgPath(svgRenderable):
    def __init__(self, coords, color='#000', stroke='1px'):
        self.tag = 'path'
        self.fill = 'none'
        self.stroke = self.parse_color(color)
        #self.stroke_width = self.parse_stroke(stroke)
        self.stroke_width = self.parse_stroke(stroke)
        self.d = self.parse_coords(coords)
    def parse_coords(self, coords):
        coord_pairs = ['%s %s' % (c[0], c[1]) for c in coords]
        return 'M %s' % ' L '.join(coord_pairs)
    def parse_stroke(self, stroke):
        if isinstance(stroke, int) or isinstance(stroke, float):
            return '%spx' % stroke
        else: return stroke
    def parse_color(self, color):
        if isinstance(color, System.Drawing.Color):
            return System.Drawing.ColorTranslator.ToHtml(color)
        else: return color

def polylineToPath(polyline, color='#000', stroke='1px'):
    # get points from polyline
    pts = [pt for pt in polyline]
    # convert them to path coords
    coords = [(p.X-origin_x, origin_y-p.Y) for p in pts]
    path = svgPath(coords, color, stroke)
    return path.render()


def svg_wrap(*args):
    wrapper = '''<svg width="''' + str(width) + '''" height="''' + str(height) + '''" xmlns="http://www.w3.org/2000/svg" version="1.1">
%s
</svg>'''
    return wrapper % '\n'.join(args)


def test():
    c1 = to_svg(tag='circle', r='10', cx=50, cy=20,
             stroke='#FF0000', fill='#0A0A0A')
    c = svgCircle(30, 70, 15)
    return svg_wrap(c1,c.render())

if GH:
    if polylines and render:
        outlist = []
        for i, p in enumerate(polylines):
            if p:
                outlist.append(polylineToPath(p, colors[i], strokes[i]))
        a = svg_wrap(*outlist)
            
            

if render:
    with open( fp + file, mode="w" ) as outfile:
        outfile.write(a)
# ---------- end python_12 ----------
python_13 = PythonScript(polylines=merge_11, colors=merge_12, strokes=merge_13, render=bool_2)  # -> out, a; inputs polylines: list of Polyline, colors: list, strokes: list of Int32, render: Boolean
# ---------- python_13: Python ----------
try:
    import Rhino
    import scriptcontext
    import System
    import rhinoscriptsyntax as rs
    GH=True
except:
    GH=False
    
bound = polylines[0]
origin_x = bound[0][0]
origin_y = bound[0][1]
width = abs( bound[0][0] - bound[2][0] )
height = abs( bound[0][1] - bound[2][1] )

fp = "C://Users//james//Documents//GitHub//blast-bot//APP//blastbot_app//data//"
file = "svgOut_R.svg"

'''This module is currently just a rough shot for sketching out ideas about svg
export.'''

def _s(o):
    if isinstance(o, str):
        if '_' in o:
            return o.replace('_','-')
        else: return o
    elif isinstance(o, System.Drawing.Color):
        return System.Drawing.ColorTranslator.ToHtml(att)
    else:
        return o

def xml_attributes(**kwargs):
    att_mask = '%s="%s"'
    return ' '.join([att_mask % (_s(k), kwargs[k]) for k in kwargs])

def to_svg(**kwargs):
    tag = kwargs.pop('tag')
    return '<%s %s />' % (tag, xml_attributes(**kwargs))

class svgRenderable(object):
    def render(self):
        if self.tag:
            return to_svg(**vars(self))
        else:
            print 'ERROR: no tag name'
            return

class svgPath(svgRenderable):
    def __init__(self, coords, color='#000', stroke='1px'):
        self.tag = 'path'
        self.fill = 'none'
        self.stroke = self.parse_color(color)
        #self.stroke_width = self.parse_stroke(stroke)
        self.stroke_width = self.parse_stroke(stroke)
        self.d = self.parse_coords(coords)
    def parse_coords(self, coords):
        coord_pairs = ['%s %s' % (c[0], c[1]) for c in coords]
        return 'M %s' % ' L '.join(coord_pairs)
    def parse_stroke(self, stroke):
        if isinstance(stroke, int) or isinstance(stroke, float):
            return '%spx' % stroke
        else: return stroke
    def parse_color(self, color):
        if isinstance(color, System.Drawing.Color):
            return System.Drawing.ColorTranslator.ToHtml(color)
        else: return color

def polylineToPath(polyline, color='#000', stroke='1px'):
    # get points from polyline
    pts = [pt for pt in polyline]
    # convert them to path coords
    coords = [(p.X-origin_x, origin_y-p.Y) for p in pts]
    path = svgPath(coords, color, stroke)
    return path.render()


def svg_wrap(*args):
    wrapper = '''<svg width="''' + str(width) + '''" height="''' + str(height) + '''" xmlns="http://www.w3.org/2000/svg" version="1.1">
%s
</svg>'''
    return wrapper % '\n'.join(args)


def test():
    c1 = to_svg(tag='circle', r='10', cx=50, cy=20,
             stroke='#FF0000', fill='#0A0A0A')
    c = svgCircle(30, 70, 15)
    return svg_wrap(c1,c.render())

if GH:
    if polylines and render:
        outlist = []
        for i, p in enumerate(polylines):
            if p:
                outlist.append(polylineToPath(p, colors[i], strokes[i]))
        a = svg_wrap(*outlist)
            
            

if render:
    with open( fp + file, mode="w" ) as outfile:
        outfile.write(a)
# ---------- end python_13 ----------

# ----
data_3 = Data(merge_6)
data_4 = Data(concat_2)
data_5 = Data(merge_7)
python_14 = PythonScript(fp=path, slot=int_3, board=data_4, initPos=start_offset_2, xScale=num_6, write=bool_7)  # -> out, a
# ---------- python_14: Python ----------
import datetime

file = "board_time.csv"


def excel_date():
    current_datetime = datetime.datetime.now()
    current_datetime.strftime('%x %X')
    return current_datetime

print excel_date

if write:
    ct = excel_date()
    
    
    line = "%i,%s,%i,%.3f,%s \n" %(slot,board[3:],initPos,xScale,ct)
    
    with open( fp + file, "a") as f:
        f.write(line)
# ---------- end python_14 ----------

panel_6 = Panel(concat)

data_6 = Data(panel_6)
python_15 = PythonScript(x=python_5, y=data_6)  # -> out, a
# ---------- python_15: Python ----------
if x == y:
    a = True
else:
    a = False
# ---------- end python_15 ----------
data_7 = Data(panel_6)

updated = Panel(python_15.a)

# ---- group: PREPEND / APPEND POSITIONING CODE
init_positioning = Panel("""G0 X0 Y-100 F50.0
G05 P8000.0""")
init_positioning_2 = Panel("""G00 Y-100.0
G00 X1985 F300.0
G05 P8000.0""")
final_positioning = Panel("""G00 Y-100 F200.0
M51
G04 P6000.0
G0 X0
G0 X0 Y0""")
final_positioning_2 = Panel("""G00 Y-100 F200.0
M51
G04 P6000.0
G0 X0
G0 X0 Y0""")
merge_14 = Merge(Data2=flatten(init_positioning), Data3=flatten(python_9.GCODE), Data4=flatten(final_positioning))  # -> flatten(Result)
merge_15 = Merge(Data2=flatten(init_positioning_2), Data3=flatten(python_10.GCODE), Data4=flatten(final_positioning_2))  # -> flatten(Result)

# ----
dispatch_2 = Dispatch(List=merge_14, DispatchPattern=null.NullFlags)  # -> ListA, ListB
dispatch_3 = Dispatch(List=merge_15, DispatchPattern=null_2.NullFlags)  # -> ListA, ListB

# ---- group: PREPEND / APPEND POSITIONING CODE (continued)
merge_16 = Merge(Data1=flatten(concat_2), Data2=flatten("$$ L BLAST $$"), Data3=flatten(dispatch_2.ListB))  # -> flatten(Result)
merge_17 = Merge(Data1=flatten(concat_2), Data2=flatten("$$ R BLAST $$"), Data3=flatten(dispatch_3.ListB))  # -> flatten(Result)

# ----
data_8 = Data(merge_16)
data_9 = Data(merge_17)
python_16 = PythonScript(Update=bool_7, board_in=data_4, l_blast_in=data_8, r_blast_in=data_9, l_clean_in=data_5, r_clean_in=data_3)  # -> a, board_out, l_blast_out, r_blast_out, l_clean_out, r_clean_out; inputs Update: Boolean, board_in: list, l_blast_in: list, r_blast_in: list, l_clean_in: list, r_clean_in: list
# ---------- python_16: Python ----------
# Make persistent variable
if "board" not in globals():
    board = 0
if "l_blast" not in globals():
    l_blast = 0
if "r_blast" not in globals():
    r_blast = 0
if "l_clean" not in globals():
    l_clean = 0
if "r_clean" not in globals():
    r_clean = 0

# Update variable
if Update:
    board = board_in
    l_blast = l_blast_in
    r_blast = r_blast_in
    l_clean = l_clean_in
    r_clean = r_clean_in

# Output variable
board_out = board
l_blast_out = l_blast
r_blast_out = r_blast
l_clean_out = l_clean
r_clean_out = r_clean
# ---------- end python_16 ----------
data_10 = Data(python_16.l_blast_out)
data_11 = Data(python_16.r_blast_out)
data_12 = Data(python_16.l_clean_out)
data_13 = Data(python_16.r_clean_out)
data_14 = Data(python_16.board_out)
fragment = TextFragment(Text=data_14, Start="3")
tmatch = MatchText(Text=fragment, Pattern=data_6, Case=True)
data_15 = Data(python_16.board_out)
data_16 = Data(data_15)
currently_loaded = Panel(data_16)
python_17 = PythonScript(code=data_10)  # -> out, newCode; inputs code: list
# ---------- python_17: Python ----------
newCode = []
offset = 0;

for i, line in enumerate(code):
    if line[0] != "$":
        newCode.append( "N" + str(i-offset) + " " + line );
    else:
        offset += 1
        newCode.append( line )
# ---------- end python_17 ----------
python_18 = PythonScript(code=data_11)  # -> out, newCode; inputs code: list; same code as python_17
python_19 = PythonScript(code=data_12)  # -> out, newCode; inputs code: list; same code as python_17
python_20 = PythonScript(code=data_13)  # -> out, newCode; inputs code: list; same code as python_17
fragment_2 = TextFragment(Text=data_14, Start="3")
python_21 = PythonScript(x=fragment_2, y=data_7)  # -> out, a; same code as python_15
tmatch_2 = MatchText(Text=fragment_2, Pattern=data_7, Case=True)
python_22 = PythonScript(CODE=python_17.newCode, x_max="300.0", y_max="80.0", mm_per_segment="1.0")  # -> out, newCode, TIME_COUNT, TIME_TOTAL; inputs CODE: list
# ---------- python_22: Python ----------
import math

lastPos = (0,0,0)
lastFeed = 50.0

TIME_COUNT = []
newCode = []

def determineFeedrate(dx, dy, f):
    vec = math.sqrt( dx*dx + dy*dy )
    vx = min( x_max, f * dx / vec)
    vy = min( y_max, f * dy / vec)
    return math.sqrt( vx * vx + vy * vy )

def atan3( dy, dx ):
    a = math.atan2( dy, dx )
    if a < 0 :
        a += math.pi * 2.0
    return a

for line in CODE:
    #skip first line
    if line[0] == "N":
        if "G" in line:
            codeType = int(line[line.find("G")+1:].split(" ")[0])
            #print codeType
            
            #for pause or dwell commands, time is specified directly
            if codeType == 4 or codeType == 5:
                time = float(line[line.find("P", 3, len(line))+1:].split(" ")[0])/1000.0
                TIME_COUNT.append( time )
            
            #for move or line commands, calculate move length and actual feedrate for time
            if codeType == 0 or codeType == 1:
                if "X" in line:
                    x_pos = float(line[line.find("X",3,len(line))+1:].split(" ")[0])
                else:
                    x_pos = lastPos[0]
                if "Y" in line:
                    y_pos = float(line[line.find("Y",3,len(line))+1:].split(" ")[0])
                else:
                    y_pos = lastPos[1]
                if "F" in line:
                    feed = float(line[line.find("F",3,len(line))+1:].split(" ")[0])
                else:
                    feed = lastFeed
                
                newPos = (x_pos, y_pos, 0)
                
                dx = newPos[0] - lastPos[0]
                dy = newPos[1] - lastPos[1]
                
                l = math.sqrt( dx*dx + dy*dy)
                
                if l == 0:
                    TIME_COUNT.append( 0 )
                    continue
                
                time_feed = min( feed, determineFeedrate(dx, dy, feed) )
                
                
                time = l / time_feed
                
                TIME_COUNT.append( time )
                
                lastPos = newPos;
                lastFeed = feed;
            
            #for arcs, discretize into line segments and count
            if codeType == 2 or codeType == 3:
                arcTime = []
                rx = float(line[line.find("I",3,len(line))+1:].split(" ")[0])
                ry = float(line[line.find("J",3,len(line))+1:].split(" ")[0])
                
                x_pos = float(line[line.find("X",3,len(line))+1:].split(" ")[0])
                y_pos = float(line[line.find("Y",3,len(line))+1:].split(" ")[0])
                
                if "F" in line:
                    feed = float(line[line.find("F",3,len(line))+1:].split(" ")[0])
                else:
                    feed = lastFeed
                
                dx = lastPos[0] - rx
                dy = lastPos[1] - ry
                
                radius = math.sqrt( dx * dx + dy * dy )
                
                angle1 = atan3( dy, dx )
                angle2 = atan3( y_pos - ry, x_pos - rx )
                theta = angle2 - angle1
                
                if codeType == 3 and theta < 0:
                    angle2 += 2 * math.pi
                elif codeType == 2 and theta > 0:
                    angle1 += 2 * math.pi
                
                theta = angle2 - angle1
                
                l = abs( theta ) * radius
                
                segments = int(math.ceil( l / mm_per_segment ))
                
                for i in range( segments ):
                    
                    scale = float(i) / float(segments)
                    
                    angle3 = (theta * scale) + angle1
                    nx = rx + math.cos(angle3) * radius
                    ny = ry + math.sin(angle3) * radius
                    
                    newPos = (nx, ny, 0)
                    
                    dx = newPos[0] - lastPos[0]
                    dy = newPos[1] - lastPos[1]
                    
                    l = math.sqrt( dx*dx + dy*dy)
                    
                    if l == 0:
                        continue
                    
                    time_feed = min( feed, determineFeedrate(dx, dy, feed) )
                    
                    
                    time = l / time_feed
                    
                    arcTime.append( time )
                    
                    lastPos = newPos;
                    lastFeed = feed;
                TIME_COUNT.append( sum(arcTime) )
                
        else:
            TIME_COUNT.append( 0 )
    else:
        TIME_COUNT.append( 0 )

TIME_TOTAL = sum(TIME_COUNT)

for i, line in enumerate(CODE):
    timeLeft = TIME_TOTAL - sum(TIME_COUNT[:i])
    timeStamp = "%02i:%02i" %(timeLeft/60, timeLeft%60)
    newCode.append( line + " *" + timeStamp )
# ---------- end python_22 ----------
python_23 = PythonScript(CODE=python_18.newCode, x_max="300.0", y_max="80.0", mm_per_segment="1.0")  # -> out, newCode, TIME_COUNT, TIME_TOTAL; inputs CODE: list; same code as python_22
python_24 = PythonScript(CODE=python_19.newCode, x_max="300.0", y_max="80.0", mm_per_segment="1.0")  # -> out, newCode, TIME_COUNT, TIME_TOTAL; inputs CODE: list; same code as python_22
python_25 = PythonScript(CODE=python_20.newCode, x_max="300.0", y_max="80.0", mm_per_segment="1.0")  # -> out, newCode, TIME_COUNT, TIME_TOTAL; inputs CODE: list; same code as python_22
addition_2 = Addition(A=python_22.TIME_TOTAL, B=python_23.TIME_TOTAL, C=python_24.TIME_TOTAL, D=python_25.TIME_TOTAL)
time = ConstructTime(Hour="0", Minute="0", Second=python_22.TIME_TOTAL)
time_2 = ConstructTime(Hour="0", Minute="0", Second=python_23.TIME_TOTAL)
time_3 = ConstructTime(Hour="0", Minute="0", Second=python_24.TIME_TOTAL)
time_4 = ConstructTime(Hour="0", Minute="0", Second=python_25.TIME_TOTAL)
time_5 = ConstructTime(Hour="0", Minute="0", Second=addition_2)
total_time_estimate = Panel(time_5)
data_17 = Data(total_time_estimate)

data_18 = Data(data_17)
total_blast_time = Panel(data_18)
updated_2 = Panel(python_21.a)

current_output_board = Panel(data_14)

left_blast_gcode = Panel(python_22.newCode)
l_time_estimate = Panel(time)

right_blast_gcode = Panel(python_23.newCode)
r_time_estimate = Panel(time_2)

left_clean_gcode = Panel(python_24.newCode)
l_time_estimate_2 = Panel(time_3)

right_clean_gcode = Panel(python_25.newCode)
r_time_estimate_2 = Panel(time_4)
